# Grasshopper definition bar_holding_acc_analysis.gh (Grasshopper 1.0.8)
# plug-ins: Pufferfish

panel = Panel("D:\0_Project\03-2025_husky_assembly\Code\husky-asembly-teleop\data\calibration_data")
rhino_doc_dir = RhinoDocDir()  # -> rhino_doc_dir
# ---------- rhino_doc_dir: Python ----------
import scriptcontext as sc
from os import path

rhino_doc_dir = path.abspath(path.dirname(sc.doc.Path))
# ---------- end rhino_doc_dir ----------
panel_2 = Panel(rhino_doc_dir)
panel_3 = Panel("20250311")
text = Text()
# everything in meters
concatenate = Concatenate(Fragment_A=rhino_doc_dir, A=text, JoinSeparator="\")
concatenate_2 = Concatenate(Fragment_A=rhino_doc_dir, B=text, A="analysis_bar_holding_acc_.json", JoinSeparator="\")
python_3_script = Python3Script(data_folder=concatenate, file_path=concatenate_2)  # -> out, simplify(joint_confs), footprint_base_link_poses, rig_point_centers, fitted_lines, closest_axes, angle_to_closest_axis, distance_com_to_polygon_center
# ---------- python_3_script: Python ----------
# requirements: compas

import json
import rhinoscriptsyntax as rs
from Rhino.Geometry import Point3d, Vector3d, Plane
import os
import Rhino.Geometry as rg 
import Grasshopper as gh
import ghpythonlib.treehelpers as th

from compas.geometry import Frame, Quaternion
from compas_rhino.conversions import frame_to_rhino

import numpy as np
# from circle_fitting_3d import Circle3D

def compute_mean_and_distance(x):
    npx = np.array(x)
    mean = np.mean(npx, axis=0)
    distances = np.linalg.norm(npx - mean, axis=1)
    return mean, distances

with open(file_path, 'r') as file:
    data = json.load(file)

joint_confs = []
footprint_base_link_poses = []
rig_point_centers = []
fitted_lines = []
closest_axes = []
angle_to_closest_axis = []
distance_com_to_polygon_center = []

for i, take_data in enumerate(data):
    joint_confs.append(take_data['joint_conf'])

    pose = take_data['footprint_pose']
    cp_frame = Frame.from_quaternion(Quaternion(pose[1][3],pose[1][0],pose[1][1],pose[1][2]), point=pose[0])
    footprint_base_link_poses.append(frame_to_rhino(cp_frame))

    rig_point_centers.append([Point3d(*p) for p in take_data['point_centers']])
    fitted_lines.append([Point3d(*take_data['fitted_line']['point']), Vector3d(*take_data['fitted_line']['direction'])])
    closest_axes.append(take_data['closest_axis'])
    angle_to_closest_axis.append(take_data['angle_to_closest_axis'])
    distance_com_to_polygon_center.append(take_data['distance_com_to_polygon_center'])

joint_confs = th.list_to_tree(joint_confs)
footprint_base_link_poses = th.list_to_tree(footprint_base_link_poses)
rig_point_centers = th.list_to_tree(rig_point_centers)
fitted_lines = th.list_to_tree(fitted_lines)
closest_axes = th.list_to_tree(closest_axes)
# ---------- end python_3_script ----------
xy_plane = XYPlane(Origin=Point(0, 0, 0))
deconstruct_plane = DeconstructPlane(Plane=xy_plane)  # -> Origin, XAxis, YAxis, ZAxis
list_item = ListItem(List=python_3_script.fitted_lines, Index=0, Wrap=True)  # -> Item, Item1
multiplication = Multiplication(A=list_item.Item1, B=0.5)
point = Point(python_3_script.rig_point_centers)
integer = Integer(python_3_script.closest_axes)
plane = Plane(python_3_script.footprint_base_link_poses)
fit_line = FitLine()
negative = Negative(Value=multiplication)
merge = Merge(Data1=deconstruct_plane.XAxis, Data2=deconstruct_plane.YAxis, Data3=deconstruct_plane.ZAxis)
panel_4 = Panel(python_3_script.joint_confs)
list_item_2 = ListItem(List=point, Index=0, Wrap=True)  # -> Item, Item1, Item2, Item3
move = Move(Geometry=list_item.Item, Motion=negative)  # -> flatten(Geometry), Transform
move_2 = Move(Geometry=list_item.Item, Motion=multiplication)  # -> flatten(Geometry), Transform
point_2 = Point(simplify(python_3_script.rig_point_centers))
distance = Distance(PointA=list_item_2.Item, PointB=list_item_2.Item1)
distance_2 = Distance(PointA=list_item_2.Item2, PointB=list_item_2.Item3)
line = Line(StartPoint=move.Geometry, EndPoint=move_2.Geometry)  # -> flatten(Line)
curve = Curve(simplify(graft(line)))
curve_closest_point = CurveClosestPoint(Point=point_2, Curve=curve)  # -> Point, Parameter, Distance
list_item_3 = ListItem(List=merge, Index=integer, Wrap=True)
panel_5 = Panel(distance)
panel_6 = Panel(distance_2)
average = Average(Input=curve_closest_point.Distance)
angle = Angle(VectorA=line, VectorB=list_item_3)  # -> Angle, Reflex
python_3_script_2 = Python3Script(angle=angle.Angle, start_pt=move.Geometry, end_pt=move_2.Geometry)  # -> out, aligned_vector, new_start_pt; inputs start_pt: Point3d, end_pt: Point3d
# ---------- python_3_script_2: Python ----------
import math
from Rhino.Geometry import Vector3d

if angle > math.pi/2:
    aligned_vector = Vector3d(start_pt - end_pt)
    new_start_pt = end_pt
else:
    aligned_vector = Vector3d(end_pt - start_pt)
    new_start_pt = start_pt
# ---------- end python_3_script_2 ----------
curve_middle = CurveMiddle(Curve=line)
point_3 = Point(plane)
move_3 = Move(Geometry=python_3_script_2.new_start_pt, Motion=list_item_3)  # -> Geometry, Transform
panel_7 = Panel(curve_closest_point.Distance)
move_4 = Move(Geometry=python_3_script_2.new_start_pt, Motion=python_3_script_2.aligned_vector)  # -> Geometry, Transform
line_2 = Line(StartPoint=point_3, EndPoint=curve_middle)
evaluate = Evaluate(Expression="1e-3 * (150 + 26*2)")
angle_2 = Angle(VectorA=python_3_script_2.aligned_vector, VectorB=list_item_3)  # -> Angle, Reflex

# ---- group: matched global axies
point_4 = Point(python_3_script_2.new_start_pt)
vector = Vector(list_item_3)
vector_display_ex = VectorDisplayEx(Point=point_4, Vector=vector, Colour=ColourSwatch(SwatchColor=RGB(101, 240, 64)), Width=2)

# ----
panel_8 = Panel(evaluate)

# ---- group: data aligned vector
point_5 = Point(python_3_script_2.new_start_pt)
vector_2 = Vector(python_3_script_2.aligned_vector)
vector_display_ex_2 = VectorDisplayEx(Point=point_5, Vector=vector_2, Colour=ColourSwatch(SwatchColor=RGB(225, 6, 255)), Width=2)

# ----
angular_dimension = AngularDimension(
    Center=python_3_script_2.new_start_pt,
    PointA=move_4.Geometry,
    PointB=move_3.Geometry,
    Reflex=False,
    Text="{0:0.0}°",
    Size=Slider(0.08, range=0.01..1))
degrees = Degrees(Radians=angle_2.Angle)
list_indices = ListIndices(List=degrees)
panel_9 = Panel(angle_2.Angle)
sort_list = SortList(Keys=degrees, ValuesA=list_indices)  # -> Keys, ValuesA
list_item_4 = ListItem(List=sort_list.ValuesA, Index=0, Wrap=True)
split_list = SplitList(List=sort_list.ValuesA, Index="46")  # -> ListA, ListB
list_item_5 = ListItem(List=point_5, Index=split_list.ListB, Wrap=True)
angular_dimension_2 = AngularDimension()
panel_10 = Panel(sort_list.Keys)
# add robot FK viz
dot_display = DotDisplay(Point=list_item_5, Colour=RGB(0, 0, 0), Size=Slider(0.1, range=0..0.1))
panel_11 = Panel(sort_list.ValuesA)
