# Grasshopper definition _1_calibration_analysis.gh (Grasshopper 1.0.8)

panel = Panel("D:\0_Project\03-2025_husky_assembly\Code\husky-asembly-teleop\data\calibration_data")
rhino_doc_dir = RhinoDocDir()  # -> rhino_doc_dir
# ---------- rhino_doc_dir: Python ----------
import scriptcontext as sc
from os import path

rhino_doc_dir = path.abspath(path.dirname(sc.doc.Path))
# ---------- end rhino_doc_dir ----------
j_axis = Slider(0, range=0..1)
panel_2 = Panel("20250311")
panel_3 = Panel(rhino_doc_dir)
concatenate = Concatenate(FragmentA="j", FragmentB=j_axis)
concatenate_2 = Concatenate(FragmentA=concatenate, FragmentB="_analysis.json")
text = Text("20260126")
vector = Vector()
reverse = Reverse(Vector=vector)
concatenate_3 = Concatenate(Fragment_A=rhino_doc_dir, A=text, JoinSeparator="\")
# everything in meters
concatenate_4 = Concatenate(Fragment_A=rhino_doc_dir, A=text, Fragment_B=concatenate, JoinSeparator="\")
panel_4 = Panel(concatenate_4)
concatenate_5 = Concatenate(Fragment_A=rhino_doc_dir, B=text, Fragment_B=concatenate, A=concatenate_2, JoinSeparator="\")
panel_5 = Panel(text)
python_3_script = Python3Script(data_folder=concatenate_4, file_path=concatenate_5)  # -> out, flange_mocap_per_take, base_mocap_per_take, base_origin_mean_per_take, base_quat_mean_per_take, base_error_per_take, circle_center_per_take, circle_normal_per_take, circle_radius_per_take
# ---------- python_3_script: Python ----------
# requirements: compas

import json
import rhinoscriptsyntax as rs
from Rhino.Geometry import Point3d, Vector3d, Plane
import os
import Rhino.Geometry as rg 
import Grasshopper as gh
import ghpythonlib.treehelpers as th

from compas.geometry import Frame, Quaternion
from compas_rhino.conversions import frame_to_rhino

import numpy as np
# from circle_fitting_3d import Circle3D

# load each json file start with the name "calibration_" in the data folder
# json_files = [f for f in os.listdir(data_folder) if f.startswith('calibration_') and f.endswith('.json')]

def compute_mean_and_distance(x):
    npx = np.array(x)
    mean = np.mean(npx, axis=0)
    distances = np.linalg.norm(npx - mean, axis=1)
    return mean, distances

with open(file_path, 'r') as file:
    data = json.load(file)

centers = []
normals = []
radius = []

# j0_point = data['fitted_point']
# j0_axis = data['fitted_axis']

base_mocap_per_take = []
flange_mocap_per_take = []
base_error_per_take = []
base_origin_mean_per_take = []
base_quat_mean_per_take = []
circle_center_per_take = []
circle_normal_per_take = []
circle_radius_per_take = []

for i, take_data in enumerate(data['takes']):
    # print('Working on file: %s', file_name)
    # file_path = os.path.join(data_folder, file_name)

    # Load the JSON file
    # with open(file_path, 'r') as file:
    #     data = json.load(file)

    # Parse the origin of mocap_pose data
    flange_mocap_planes = []
    base_mocap_planes = []
    base_o = []
    base_q = []
    for entry in take_data['raw_data']:
        flange_mocap_pose = entry.get("flange_mocap_pose", [])
        base_mocap_pose = entry.get("base_mocap_pose", [])
        if flange_mocap_pose:
            cp_frame = Frame.from_quaternion(Quaternion(flange_mocap_pose[1][3],flange_mocap_pose[1][0],flange_mocap_pose[1][1],flange_mocap_pose[1][2]), point=flange_mocap_pose[0])
            flange_mocap_planes.append(frame_to_rhino(cp_frame))
        if base_mocap_pose:
            cp_frame = Frame.from_quaternion(Quaternion(base_mocap_pose[1][3],base_mocap_pose[1][0],base_mocap_pose[1][1],base_mocap_pose[1][2]), point=base_mocap_pose[0])
            base_mocap_planes.append(frame_to_rhino(cp_frame))
            base_o.append(base_mocap_pose[0])
            base_q.append(base_mocap_pose[1])

    base_mocap_per_take.append(base_mocap_planes)
    flange_mocap_per_take.append(flange_mocap_planes)

    base_o_mean, o_distances = compute_mean_and_distance(base_o)
    base_origin_mean_per_take.append(rg.Point3d(*base_o_mean))
    
    base_q_mean, q_distances = compute_mean_and_distance(base_q)
    base_quat_mean_per_take.append(base_q_mean)
    
    base_error_per_take.append([max(o_distances), max(q_distances)])

    circle_center_per_take.append(Point3d(*take_data['center']))
    circle_normal_per_take.append(Vector3d(*take_data['normal']))
    # circle_radius_per_take.append(take_data['radius'])

base_mocap_per_take = th.list_to_tree(base_mocap_per_take)
flange_mocap_per_take = th.list_to_tree(flange_mocap_per_take)

base_origin_mean_per_take = th.list_to_tree(base_origin_mean_per_take)
base_quat_mean_per_take = th.list_to_tree(base_quat_mean_per_take)
base_error_per_take = th.list_to_tree(base_error_per_take)

# fitted_point = Point3d(*data['fitted_point'])
# fitted_axis = Vector3d(*data['fitted_axis'])
# ---------- end python_3_script ----------

base_mocap_origin_mean_per_take = Panel(python_3_script.base_origin_mean_per_take)
base_origin_quat_distance_to_mean = Panel(python_3_script.base_error_per_take)

point = Point(flatten(python_3_script.base_mocap_per_take))
average = Average(Input=point)
base_mocap_origin_mean_per_take_2 = Panel(python_3_script.base_quat_mean_per_take)
subtraction = Subtraction(A=average, B=point)

# ---- group: j1
point_2 = Point(Point(-0.2592390683, -0.2478016496, 0.140064121))
vector_2 = Vector(Vector(-0.9992267559, 0.037915935, -0.01040214904))

# ---- group: j0
point_3 = Point(Point(-0.01696381485, -0.3716816677, 0.257175103))
vector_3 = Vector(Vector(-0.03269831116, -0.7066556155, 0.7068015229))

# ----
reverse_2 = Reverse(Vector=vector_2)
vector_display_ex = VectorDisplayEx(Point=point_3, Vector=vector_3, Colour=ColourSwatch(SwatchColor=RGB(0, 0, 255)), Width=2)
vector_display_ex_2 = VectorDisplayEx(Point=point_2, Vector=vector_2, Colour=ColourSwatch(SwatchColor=RGB(255, 0, 0)), Width=2)
angle = Angle(VectorA=vector_3, VectorB=vector_2)  # -> Angle, Reflex
cross_product = CrossProduct(VectorA=vector_3, VectorB=vector_2, Unitize=False)  # -> Vector, Length
plane_normal = PlaneNormal(Origin=point_2, ZAxis=cross_product.Vector)
plane_normal_2 = PlaneNormal(Origin=point_3, ZAxis=vector_2)
degrees = Degrees(Radians=angle.Angle)
unit_vector = UnitVector(Vector=vector_3)
plane_plane = PlanePlane(PlaneA=plane_normal_2, PlaneB=plane_normal)
panel_6 = Panel(degrees)
curve_closest_point = CurveClosestPoint(Point=point_2, Curve=plane_plane)  # -> Point, Parameter, Distance
negative = Negative(Value=unit_vector)
panel_7 = Panel("0.1625")
cross_product_2 = CrossProduct(VectorA=vector_3, VectorB=vector_2, Unitize=True)  # -> Vector, Length
custom_preview = CustomPreview(Geometry=plane_plane, Material=ColourSwatch(SwatchColor=RGB(255, 255, 0)))
distance = Distance(PointA=point_2, PointB=curve_closest_point.Point)

# ---- group: axis intersection point
point_4 = Point(curve_closest_point.Point)

# ---- group: y axis
vector_4 = Vector(cross_product_2.Vector)

# ---- group: z axis
vector_5 = Vector(vector_3)

# ----
cross_product_3 = CrossProduct(VectorA=vector_4, VectorB=vector_5, Unitize=True)  # -> Vector, Length
panel_8 = Panel(distance)
left_ur_arm_shoulder_pan_joint = Panel("0.16257807277263761")
alice = Panel("0.16277742194953954")
multiplication = Multiplication(A=alice, B=negative)
move = Move(Geometry=point_4, Motion=multiplication)  # -> Geometry, Transform
right_ur_arm_shoulder_pan_joint = Panel("0.1627782525221701")

# ---- group: x axis
vector_6 = Vector(cross_product_3.Vector)

# ----
angle_2 = Angle(VectorA=vector_6, VectorB=vector_2)  # -> Angle, Reflex
degrees_2 = Degrees(Radians=angle_2.Angle)
angle_deg_difference_in_x_axis = Panel(degrees_2)
save_json = Button()
text_2 = Text(concatenate_3)
construct_plane = ConstructPlane(Origin=move.Geometry, XAxis=vector_6, YAxis=vector_4)
python_3_script_2 = Python3Script(save=save_json, plane=construct_plane, target_folder=text_2)  # -> out, a; inputs plane: Plane
# ---------- python_3_script_2: Python ----------
import json
import os
from compas.geometry import Frame, Plane


cp_frame = Frame.from_plane(Plane.from_point_and_two_vectors(
    plane.Origin, plane.XAxis, plane.YAxis))

# Build the 4x4 transformation matrix
base_frame_transformation_matrix = [
    list(plane.XAxis) + [plane.Origin[0]],
    list(plane.YAxis) + [plane.Origin[1]],
    list(plane.ZAxis) + [plane.Origin[2]],
    [0.0, 0.0, 0.0, 1.0]
]

# Create the JSON structure
calibration_data = {
    "base_frame_transformation_matrix": base_frame_transformation_matrix
}

# Define the target folder path (modify this to your desired path)
# target_folder = r"C:\path\to\your\folder"  # Change this to your target folder
file_path = os.path.join(target_folder, "base_frame_calibration_GH.json")

if save:
    # Save to JSON file
    with open(file_path, 'w') as f:
        json.dump(calibration_data, f, indent=4)

    print('Calibration file saved to:', file_path)

# Optional: print the values for verification
print('tf[:3, 0] = ', list(plane.XAxis))
print('tf[:3, 1] = ', list(plane.YAxis))
print('tf[:3, 2] = ', list(plane.ZAxis))
print('tf[:3, 3] = ', list(plane.Origin))
# ---------- end python_3_script_2 ----------
python_3_script_3 = Python3Script()  # -> out, plane, x_line, y_line, z_line, point, T
# ---------- python_3_script_3: Python ----------
"""
Visualize transformation matrix using COMPAS in Grasshopper/Rhino
Paste this script into a GhPython component in Grasshopper
"""

import Rhino.Geometry as rg
from compas.geometry import Frame, Transformation
import math

# Input transformation matrix (from mm to m conversion needed for position)
matrix_data = [
    [ 5.81943833e-03,  9.99960425e-01, -6.72924004e-03, -2.94601893e+02],
    [-7.08650905e-01, -6.23950351e-04, -7.05559003e-01, -1.09061389e+02],
    [-7.05535279e-01,  8.87463915e-03,  7.08619229e-01,  4.85543005e+02],
    [ 0.00000000e+00,  0.00000000e+00,  0.00000000e+00,  1.00000000e+00]
]

# Scale position column from mm to m (last column, first 3 rows)
matrix_data[0][3] = matrix_data[0][3] / 1000.0  # -294.601893 mm -> -0.294601893 m
matrix_data[1][3] = matrix_data[1][3] / 1000.0  # -109.061389 mm -> -0.109061389 m
matrix_data[2][3] = matrix_data[2][3] / 1000.0  # 485.543005 mm -> 0.485543005 m

# Create COMPAS Transformation from matrix
T = Transformation(matrix_data)

# Extract frame from transformation
frame = Frame.from_transformation(T)

# Convert COMPAS frame to Rhino plane for visualization
point = rg.Point3d(frame.point[0], frame.point[1], frame.point[2])
xaxis = rg.Vector3d(frame.xaxis[0], frame.xaxis[1], frame.xaxis[2])
yaxis = rg.Vector3d(frame.yaxis[0], frame.yaxis[1], frame.yaxis[2])

# Create Rhino plane
plane = rg.Plane(point, xaxis, yaxis)

# Create visualization geometry
# Frame axes as lines (scaled for visibility)
scale = 0.1  # 100mm axis length for visualization

x_line = rg.Line(point, point + xaxis * scale)
y_line = rg.Line(point, point + yaxis * scale)
z_line = rg.Line(point, point + plane.ZAxis * scale)

# Output information
print("Transformation Matrix (position in meters):")
for row in matrix_data:
    print([f"{val:12.6e}" if abs(val) > 0.001 or val == 0 else f"{val:12.9f}" for val in row])

print("\nFrame Information:")
print(f"Origin: ({frame.point[0]:.6f}, {frame.point[1]:.6f}, {frame.point[2]:.6f}) m")
print(f"X-axis: ({frame.xaxis[0]:.6f}, {frame.xaxis[1]:.6f}, {frame.xaxis[2]:.6f})")
print(f"Y-axis: ({frame.yaxis[0]:.6f}, {frame.yaxis[1]:.6f}, {frame.yaxis[2]:.6f})")
print(f"Z-axis: ({frame.zaxis[0]:.6f}, {frame.zaxis[1]:.6f}, {frame.zaxis[2]:.6f})")

# Outputs for Grasshopper
a = plane          # Output plane
b = x_line        # X-axis line (typically red)
c = y_line        # Y-axis line (typically green)
d = z_line        # Z-axis line (typically blue)
e = point         # Origin point
f = T             # COMPAS Transformation object
# ---------- end python_3_script_3 ----------
vector_display_ex_3 = VectorDisplayEx(Point=move.Geometry, Vector=vector_4, Colour=ColourSwatch(SwatchColor=RGB(77, 255, 0)), Width=2)
panel_9 = Panel(python_3_script_2.out)

# ---- group: line fitted by centers
vector_7 = Vector(vector)

# ---- group: circle fitting check
# j0: sort by z
# j1: sort by x
point_5 = Point(python_3_script.circle_center_per_take)
deconstruct = Deconstruct(Point=point_5)  # -> XComponent, YComponent, ZComponent
vector_8 = Vector(python_3_script.circle_normal_per_take)
number = Number(python_3_script.circle_radius_per_take)
stream_filter = StreamFilter(Gate=j_axis, Stream0=deconstruct.ZComponent, Stream1=deconstruct.XComponent)
point_6 = Point(simplify(python_3_script.flange_mocap_per_take))
sort_points = SortPoints(Points=point_5)  # -> Points, Indices

# ---- group: circle fitting check / radius
sort_list = SortList(Keys=stream_filter, ValuesValuesA=number)  # -> Keys, ValuesValuesA

# ---- group: circle fitting check / normal
sort_list_2 = SortList(Keys=stream_filter, ValuesValuesA=vector_8)  # -> Keys, ValuesValuesA

# ---- group: take the average normal as the axis vector
average_2 = Average(Input=sort_list_2.ValuesValuesA)

# ----
vector_9 = Vector(average_2)
panel_10 = Panel(vector_9)
angle_3 = Angle(VectorA=average_2, VectorB=sort_list_2.ValuesValuesA)  # -> Angle, Reflex
angle_4 = Angle(VectorA=vector, VectorB=sort_list_2.ValuesValuesA)  # -> Angle, Reflex
degrees_3 = Degrees(Radians=angle_3.Angle)
degrees_4 = Degrees(Radians=angle_4.Angle)
angle_diff_to_mean_circle_normal = Panel(degrees_3)
angle_diff_to_mean_fitted_line = Panel(degrees_4)
vector_10 = Vector(average_2)

# ---- group: circle fitting check / center
sort_list_3 = SortList(Keys=stream_filter, ValuesValuesA=point_5)  # -> Keys, ValuesValuesA

# ---- group: circle centers
point_7 = Point(sort_list_3.ValuesValuesA)

# ----
list_item = ListItem(List=point_7, Index=0, Wrap=True)
plane_normal_3 = PlaneNormal(Origin=list_item, ZAxis=vector_9)
panel_11 = Panel(plane_normal_3)
project = Project(Geometry=point_7, Plane=plane_normal_3)  # -> Geometry, Transform
point_8 = Point(project.Geometry)

# ---- group: take the projected centers's average as the axis anchor point
average_3 = Average(Input=point_8)

# ----
distance_2 = Distance(PointA=average_3, PointB=point_8)

# ---- group: averaged normals
point_9 = Point(average_3)
vector_11 = Vector(vector_9)
vector_display_ex_4 = VectorDisplayEx(Point=point_9, Vector=vector_11, Colour=ColourSwatch(SwatchColor=RGB(101, 240, 64)), Width=2)

# ---- group: line fitted by centers (continued)
point_10 = Point(average_3)
vector_display_ex_5 = VectorDisplayEx(Point=point_10, Vector=vector_7, Colour=ColourSwatch(SwatchColor=RGB(255, 251, 41)), Width=2)

# ---- group: normals
point_11 = Point(average_3)
vector_12 = Vector(vector_8)
vector_display_ex_6 = VectorDisplayEx(Point=point_11, Vector=vector_12, Colour=ColourSwatch(SwatchColor=RGB(225, 6, 255)), Width=2)

# ----
projected_centers_distance_to_mean = Panel(distance_2)
point_12 = Point(average_3)

# ---- group: circle fitting check (continued)
plane_normal_4 = PlaneNormal(Origin=point_5, ZAxis=sort_list_2.ValuesValuesA)
circle = Circle(Plane=plane_normal_4, Radius=sort_list.ValuesValuesA)  # -> simplify(graft(Circle))
curve_closest_point_2 = CurveClosestPoint(Point=point_6, Curve=circle)  # -> Point, Parameter, Distance
distance_3 = Distance(PointA=point_6, PointB=curve_closest_point_2.Point)  # -> simplify(Distance)
shift_list = ShiftList(List=sort_list_3.ValuesValuesA, Shift=1, Wrap=False)
shift_list_2 = ShiftList(List=sort_list_3.ValuesValuesA, Shift=-1, Wrap=False)
sort_list_4 = SortList(Keys=distance_3)  # -> reverse(Keys), ValuesValuesA
average_4 = Average(Input=distance_3)
distance_4 = Distance(PointA=shift_list_2, PointB=shift_list)
line = Line(StartPoint=shift_list_2, EndPoint=shift_list)
list_item_2 = ListItem(List=sort_list_4.Keys, Index=0, Wrap=True)
panel_12 = Panel(average_4)
panel_13 = Panel(list_item_2)
curve_middle = CurveMiddle(Curve=line)
distance_between_circle_centers = Panel(distance_4)
text_tag = TextTag(Location=curve_middle, Text=distance_4)
