# Grasshopper definition calibration_analysis.gh (Grasshopper 1.0.8)

panel = Panel("D:\0_Project\03-2025_husky_assembly\Code\husky-asembly-teleop\data\calibration_data")
rhino_doc_dir = RhinoDocDir()  # -> rhino_doc_dir
# ---------- rhino_doc_dir: Python ----------
import scriptcontext as sc
from os import path

rhino_doc_dir = path.abspath(path.dirname(sc.doc.Path))
# ---------- end rhino_doc_dir ----------
number_slider = Slider(1, range=0..1)
panel_2 = Panel(rhino_doc_dir)
panel_3 = Panel("20250311")
concatenate = Concatenate(FragmentA="j", FragmentB=number_slider)
concatenate_2 = Concatenate(FragmentA=concatenate, FragmentB="_analysis.json")
text = Text()
concatenate_3 = Concatenate(Fragment_A=rhino_doc_dir, B=text, Fragment_B=concatenate, A=concatenate_2, JoinSeparator="\")
# everything in meters
concatenate_4 = Concatenate(Fragment_A=rhino_doc_dir, A=text, Fragment_B=concatenate, JoinSeparator="\")
python_3_script = Python3Script(data_folder=concatenate_4, file_path=concatenate_3)  # -> out, flange_mocap_per_take, base_mocap_per_take, base_origin_mean_per_take, base_quat_mean_per_take, base_error_per_take, circle_center_per_take, circle_normal_per_take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
# ---------- python_3_script: Python ----------
# requirements: compas

import json
import rhinoscriptsyntax as rs
from Rhino.Geometry import Point3d, Vector3d, Plane
import os
import Rhino.Geometry as rg 
import Grasshopper as gh
import ghpythonlib.treehelpers as th

from compas.geometry import Frame, Quaternion
from compas_rhino.conversions import frame_to_rhino

import numpy as np
# from circle_fitting_3d import Circle3D

# load each json file start with the name "calibration_" in the data folder
# json_files = [f for f in os.listdir(data_folder) if f.startswith('calibration_') and f.endswith('.json')]

def compute_mean_and_distance(x):
    npx = np.array(x)
    mean = np.mean(npx, axis=0)
    distances = np.linalg.norm(npx - mean, axis=1)
    return mean, distances

with open(file_path, 'r') as file:
    data = json.load(file)

centers = []
normals = []
radius = []

j0_point = data['fitted_point']
j0_axis = data['fitted_axis']

base_mocap_per_take = []
flange_mocap_per_take = []
base_error_per_take = []
base_origin_mean_per_take = []
base_quat_mean_per_take = []
circle_center_per_take = []
circle_normal_per_take = []
circle_radius_per_take = []

for i, take_data in enumerate(data['takes']):
    # print('Working on file: %s', file_name)
    # file_path = os.path.join(data_folder, file_name)

    # Load the JSON file
    # with open(file_path, 'r') as file:
    #     data = json.load(file)

    # Parse the origin of mocap_pose data
    flange_mocap_planes = []
    base_mocap_planes = []
    base_o = []
    base_q = []
    for entry in take_data['raw_data']:
        flange_mocap_pose = entry.get("flange_mocap_pose", [])
        base_mocap_pose = entry.get("base_mocap_pose", [])
        if flange_mocap_pose:
            cp_frame = Frame.from_quaternion(Quaternion(flange_mocap_pose[1][3],flange_mocap_pose[1][0],flange_mocap_pose[1][1],flange_mocap_pose[1][2]), point=flange_mocap_pose[0])
            flange_mocap_planes.append(frame_to_rhino(cp_frame))
        if base_mocap_pose:
            cp_frame = Frame.from_quaternion(Quaternion(base_mocap_pose[1][3],base_mocap_pose[1][0],base_mocap_pose[1][1],base_mocap_pose[1][2]), point=base_mocap_pose[0])
            base_mocap_planes.append(frame_to_rhino(cp_frame))
            base_o.append(base_mocap_pose[0])
            base_q.append(base_mocap_pose[1])

    base_mocap_per_take.append(base_mocap_planes)
    flange_mocap_per_take.append(flange_mocap_planes)

    base_o_mean, o_distances = compute_mean_and_distance(base_o)
    base_origin_mean_per_take.append(rg.Point3d(*base_o_mean))
    
    base_q_mean, q_distances = compute_mean_and_distance(base_q)
    base_quat_mean_per_take.append(base_q_mean)
    
    base_error_per_take.append([max(o_distances), max(q_distances)])

    circle_center_per_take.append(Point3d(*take_data['center']))
    circle_normal_per_take.append(Vector3d(*take_data['normal']))
    circle_radius_per_take.append(take_data['radius'])

base_mocap_per_take = th.list_to_tree(base_mocap_per_take)
flange_mocap_per_take = th.list_to_tree(flange_mocap_per_take)

base_origin_mean_per_take = th.list_to_tree(base_origin_mean_per_take)
base_quat_mean_per_take = th.list_to_tree(base_quat_mean_per_take)
base_error_per_take = th.list_to_tree(base_error_per_take)

fitted_point = Point3d(*data['fitted_point'])
fitted_axis = Vector3d(*data['fitted_axis'])
# ---------- end python_3_script ----------
vector = Vector(python_3_script.fitted_axis)
reverse = Reverse(Vector=vector)

base_mocap_origin_mean_per_take = Panel(python_3_script.base_origin_mean_per_take)
base_origin_quat_distance_to_mean = Panel(python_3_script.base_error_per_take)

point = Point(flatten(python_3_script.base_mocap_per_take))
average = Average(Input=point)
base_mocap_origin_mean_per_take_2 = Panel(python_3_script.base_quat_mean_per_take)
subtraction = Subtraction(A=average, B=point)
distance = Distance(PointA=average)

# ---- group: j1
point_2 = Point(Point(-1.461413435, -0.4550132501, 0.6115800168))
vector_2 = Vector(Vector(0.9980327581, -0.06246519643, 0.005345077237))

# ---- group: j0
point_3 = Point(Point(-1.215499075, -0.4700270266, 0.9465791739))
vector_3 = Vector(Vector(-0.004502519674, 0.0002599132133, 0.9999896906))

# ----
reverse_2 = Reverse(Vector=vector_2)
vector_display_ex = VectorDisplayEx(Point=point_3, Vector=vector_3, Colour=ColourSwatch(SwatchColor=RGB(0, 0, 255)), Width=2)
vector_display_ex_2 = VectorDisplayEx(Point=point_2, Vector=vector_2, Colour=ColourSwatch(SwatchColor=RGB(255, 0, 0)), Width=2)
cross_product = CrossProduct(VectorA=vector_3, VectorB=vector_2, Unitize=False)  # -> Vector, Length
angle = Angle(VectorA=vector_3, VectorB=vector_2)  # -> Angle, Reflex
plane_normal = PlaneNormal(Origin=point_3, ZAxis=vector_2)
plane_normal_2 = PlaneNormal(Origin=point_2, ZAxis=cross_product.Vector)
degrees = Degrees(Radians=angle.Angle)
unit_vector = UnitVector(Vector=vector_3)
plane_plane = PlanePlane(PlaneA=plane_normal, PlaneB=plane_normal_2)
panel_4 = Panel(degrees)
curve_closest_point = CurveClosestPoint(Point=point_2, Curve=plane_plane)  # -> Point, Parameter, Distance
negative = Negative(Value=unit_vector)
cross_product_2 = CrossProduct(VectorA=vector_3, VectorB=vector_2, Unitize=True)  # -> Vector, Length
multiplication = Multiplication(A="0.1625", B=negative)
distance_2 = Distance(PointA=point_2, PointB=curve_closest_point.Point)

# ---- group: axis intersection point
point_4 = Point(curve_closest_point.Point)

# ---- group: y axis
vector_4 = Vector(cross_product_2.Vector)

# ---- group: z axis
vector_5 = Vector(vector_3)

# ----
move = Move(Geometry=point_4, Motion=multiplication)  # -> Geometry, Transform
cross_product_3 = CrossProduct(VectorA=vector_4, VectorB=vector_5, Unitize=True)  # -> Vector, Length
panel_5 = Panel(distance_2)

# ---- group: x axis
vector_6 = Vector(cross_product_3.Vector)

# ----
angle_2 = Angle(VectorA=vector_6, VectorB=vector_2)  # -> Angle, Reflex
degrees_2 = Degrees(Radians=angle_2.Angle)
angle_deg_difference_in_x_axis = Panel(degrees_2)
construct_plane = ConstructPlane(Origin=move.Geometry, XAxis=vector_6, YAxis=vector_4)
python_3_script_2 = Python3Script(plane=construct_plane)  # -> out, a; inputs plane: Plane
# ---------- python_3_script_2: Python ----------
from compas.geometry import Frame, Plane


cp_frame = Frame.from_plane(Plane.from_point_and_two_vectors(
    plane.Origin, plane.XAxis, plane.YAxis))

# print('pos = ', list(cp_frame.point))
# print('quat = ', list(cp_frame.quaternion))

# print('tf[:3, 0] = ', list(cp_frame.xaxis))
# print('tf[:3, 1] = ', list(cp_frame.yaxis))
# print('tf[:3, 2] = ', list(cp_frame.zaxis))
# print('tf[:3, 3] = ', list(cp_frame.point))

print('tf[:3, 0] = ', list(plane.XAxis))
print('tf[:3, 1] = ', list(plane.YAxis))
print('tf[:3, 2] = ', list(plane.ZAxis))
print('tf[:3, 3] = ', list(plane.Origin))
# ---------- end python_3_script_2 ----------
vector_display_ex_3 = VectorDisplayEx(Point=move.Geometry, Vector=vector_4, Colour=ColourSwatch(SwatchColor=RGB(77, 255, 0)), Width=2)
panel_6 = Panel(python_3_script_2.out)
panel_7 = Panel(vector_6)

# ---- group: circle fitting check
# j0: sort by z
# j1: sort by x
point_5 = Point(python_3_script.circle_center_per_take)
deconstruct = Deconstruct(Point=point_5)  # -> XComponent, YComponent, ZComponent
vector_7 = Vector(python_3_script.circle_normal_per_take)
number = Number(python_3_script.circle_radius_per_take)
stream_filter = StreamFilter(Gate=number_slider, Stream0=deconstruct.ZComponent, Stream1=deconstruct.XComponent)
point_6 = Point(simplify(python_3_script.flange_mocap_per_take))

# ---- group: radius
sort_list = SortList(Keys=stream_filter, ValuesValuesA=number)  # -> Keys, ValuesValuesA

# ---- group: circle fitting check / normal
sort_list_2 = SortList(Keys=stream_filter, ValuesValuesA=vector_7)  # -> Keys, ValuesValuesA

# ---- group: take the average normal as the axis vector
average_2 = Average(Input=sort_list_2.ValuesValuesA)

# ----
vector_8 = Vector(average_2)
panel_8 = Panel(vector_8)
angle_3 = Angle(VectorA=average_2, VectorB=sort_list_2.ValuesValuesA)  # -> Angle, Reflex
angle_4 = Angle(VectorA=vector, VectorB=sort_list_2.ValuesValuesA)  # -> Angle, Reflex

# ---- group: circle fitting check / center
sort_list_3 = SortList(Keys=stream_filter, ValuesValuesA=point_5)  # -> Keys, ValuesValuesA

# ---- group: circle centers
point_7 = Point(sort_list_3.ValuesValuesA)

# ----
# Why this is erasing the nuances in the normal vector?
list_item = ListItem(List=point_7, Index=0, Wrap=True)
plane_normal_3 = PlaneNormal(Origin=list_item, ZAxis=vector_8)
panel_9 = Panel(plane_normal_3)
project = Project(Geometry=point_7, Plane=plane_normal_3)  # -> Geometry, Transform
point_8 = Point(project.Geometry)
degrees_3 = Degrees(Radians=angle_3.Angle)
degrees_4 = Degrees(Radians=angle_4.Angle)

# ---- group: circle fitting check (continued)
plane_normal_4 = PlaneNormal(Origin=point_5, ZAxis=sort_list_2.ValuesValuesA)
circle = Circle(Plane=plane_normal_4, Radius=sort_list.ValuesValuesA)  # -> simplify(graft(Circle))
curve_closest_point_2 = CurveClosestPoint(Point=point_6, Curve=circle)  # -> Point, Parameter, Distance
distance_3 = Distance(PointA=point_6, PointB=curve_closest_point_2.Point)  # -> simplify(Distance)
sort_list_4 = SortList(Keys=distance_3)  # -> reverse(Keys), ValuesValuesA
average_3 = Average(Input=distance_3)
list_item_2 = ListItem(List=sort_list_4.Keys, Index=0, Wrap=True)
panel_10 = Panel(average_3)
panel_11 = Panel(list_item_2)

# ---- group: take the projected centers's average as the axis anchor point
average_4 = Average(Input=point_8)

# ----
distance_4 = Distance(PointA=average_4, PointB=point_8)
angle_diff_to_mean_circle_normal = Panel(degrees_3)
angle_diff_to_mean_fitted_line = Panel(degrees_4)
sort_points = SortPoints(Points=point_5)  # -> Points, Indices

# ---- group: averaged normals
point_9 = Point(average_4)
vector_9 = Vector(vector_8)
vector_display_ex_4 = VectorDisplayEx(Point=point_9, Vector=vector_9, Colour=ColourSwatch(SwatchColor=RGB(101, 240, 64)), Width=2)

# ---- group: line fitted by centers
point_10 = Point(average_4)
vector_10 = Vector(vector)
vector_display_ex_5 = VectorDisplayEx(Point=point_10, Vector=vector_10, Colour=ColourSwatch(SwatchColor=RGB(255, 251, 41)), Width=2)

# ---- group: normals
point_11 = Point(average_4)
vector_11 = Vector(vector_7)
vector_display_ex_6 = VectorDisplayEx(Point=point_11, Vector=vector_11, Colour=ColourSwatch(SwatchColor=RGB(225, 6, 255)), Width=2)

# ----
projected_centers_distance_to_mean = Panel(distance_4)
shift_list = ShiftList(List=sort_list_3.ValuesValuesA, Shift=1, Wrap=False)
shift_list_2 = ShiftList(List=sort_list_3.ValuesValuesA, Shift=-1, Wrap=False)
point_12 = Point(average_4)
vector_12 = Vector(average_2)
distance_5 = Distance(PointA=shift_list_2, PointB=shift_list)
line = Line(StartPoint=shift_list_2, EndPoint=shift_list)
curve_middle = CurveMiddle(Curve=line)
distance_between_circle_centers = Panel(distance_5)
text_tag = TextTag(Location=curve_middle, Text=distance_5)
