# Grasshopper definition RobotX_demo_keyframe_v3_save_a_pair_of_states_with_tools_support_robot.gh (Grasshopper 1.0.8)

# ---- group: automatically find relative path
rhino_doc_dir = RhinoDocDir()  # -> rhino_doc_dir
# ---------- rhino_doc_dir: Python ----------
import scriptcontext as sc
from os import path

rhino_doc_dir = path.abspath(path.dirname(sc.doc.Path))
# ---------- end rhino_doc_dir ----------
python_3_script = Python3Script(here=rhino_doc_dir, design_folder="250806_RobotX_box_redo")  # -> out, husky_urdf_path
# ---------- python_3_script: Python ----------
import os
husky_urdf_path = os.path.abspath(os.path.join(here, '..', '..', 
    'data', 'husky_urdf'))
# ---------- end python_3_script ----------
python_3_script_2 = Python3Script(here=rhino_doc_dir, design_folder="250806_RobotX_box_redo")  # -> out, design_study_path
# ---------- python_3_script_2: Python ----------
import os
design_study_path = os.path.abspath(os.path.join(here, '..', '..', 
    'data', 'husky_assembly_design_study', design_folder))
# ---------- end python_3_script_2 ----------

# ----
panel = Panel(python_3_script.husky_urdf_path)

# ----
# Single-arm Husky
panel_2 = Panel("husky_ur5_e_no_base_joint.urdf")
load_robot = Button()
python_3_script_3 = Python3Script(load=load_robot, pkg_path=panel, pkg_name="mt_husky_moveit_config", urdf_file=panel_2, srdf_file="husky.srdf")  # -> out, robot_model, robot_semantics
# ---------- python_3_script_3: Python ----------
from scriptcontext import sticky as st
import os
import compas

from compas_robots import RobotModel
from compas_robots.resources import GithubPackageMeshLoader
from compas_robots.resources import LocalPackageMeshLoader
from compas_robots.ghpython.scene import RobotModelObject
# from compas_fab.robots import Robot
from compas_fab.robots import RobotSemantics
# from compas_ghpython.artists import RobotModelArtist

# Robot meshes are usually in meters
# Set a high percision to prevent parsing errors
# and configure Rhino itself in meters
compas.PRECISION = '12f'

# Store robot in component-based key
# ghenv.Component.InstanceGuid
robot_key = 'robot_{}'.format(str('single-arm_husky_Alice'))

if robot_key not in st:
    st[robot_key] = None

loader = LocalPackageMeshLoader(os.path.join(pkg_path), pkg_name)

if load:
# if True:
    # Also load geometry
    husky_loader = LocalPackageMeshLoader(os.path.join(pkg_path), "husky_description")
    dualarm_husky_loader = LocalPackageMeshLoader(os.path.join(pkg_path), "husky_ur_description")
    ur_loader = LocalPackageMeshLoader(os.path.join(pkg_path), "ur_description")
    
    # Create robot model from URDF
    model = RobotModel.from_urdf_string(loader.load_urdf(urdf_file).read())
    model.load_geometry(loader, husky_loader, dualarm_husky_loader, ur_loader)
    print(model)

    # # artist = RobotModelArtist(model)
    # scene_object = RobotModelObject(item=model)

    # # robot = Robot(model)
    # robot = Robot(model, scene_object, semantics=robot_semantics)
##    robot.scale(1000)
    st[robot_key] = model

robot_model = st[robot_key]
robot_semantics = None
if srdf_file:
    robot_semantics = RobotSemantics.from_srdf_file(loader.build_path('config', srdf_file), robot_model)


#repo    = 'ros-industrial/abb'
#package = 'abb_irb6600_support'
#branch  = 'kinetic-devel'
#
#github = GithubPackageMeshLoader(repo, package, branch)
#
#model = RobotModel.from_urdf_file(github.load_urdf('irb6640.urdf'))
#model.load_geometry(github)
#artist = RobotModelArtist(model)
#robot = Robot(model, artist)
# ---------- end python_3_script_3 ----------

number_slider = Slider(0.9, range=0..2)

point = Point(Point(0, 100, 0))
point_2 = Point(Point(0, 0, 0))
point_3 = Point(Point(100, 0, 0))
mesh = Mesh([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])
plane_3pt = Plane3Pt(PointA=point_2, PointB=point_3, PointC=point)
orient = Orient(Geometry=mesh, Source=plane_3pt, Target=PlaneXY(0, 0, 0))  # -> Geometry, Transform
point_4 = Point(Point(3.917690688e-09, 100, 166.1309561))
point_5 = Point(Point(3.917690688e-09, -8.756071423e-10, 166.1309561))
point_6 = Point(Point(100, -8.756071423e-10, 166.1309561))
scale = Scale(Geometry=orient.Geometry, Center=Point(0, 0, 0), Factor="0.001")  # -> Geometry, Transform
plane_3pt_2 = Plane3Pt(PointA=point_5, PointB=point_6, PointC=point_4)
python_3_script_4 = Python3Script(name="RobotiqGripper", tool_visual_meshes=scale.Geometry, tool_collision_meshes=scale.Geometry, tool_frame=plane_3pt_2)  # -> out, tool_model; inputs tool_visual_meshes: list of Mesh, tool_collision_meshes: list of Mesh, tool_frame: Plane
# ---------- python_3_script_4: Python ----------
from compas_robots import ToolModel
from compas.geometry import Transformation
from compas_rhino.conversions import plane_to_compas_frame, mesh_to_compas

cp_visual_meshes = [mesh_to_compas(vm) for vm in tool_visual_meshes]
cp_collision_meshes = [mesh_to_compas(vm) for vm in tool_collision_meshes]
cp_tool_frame = plane_to_compas_frame(tool_frame)

tool_model = ToolModel(None, cp_tool_frame, None, name)

tool_model.add_link("attached_tool_link", visual_meshes=cp_visual_meshes, collision_meshes=cp_collision_meshes)
tool_model._rebuild_tree()
tool_model._create(tool_model.root, Transformation())
# ---------- end python_3_script_4 ----------

point_7 = Point(Point(-45, 70, -109.75))
point_8 = Point(Point(-45, -30, -109.75))
point_9 = Point(Point(55, -30, -109.75))
mesh_2 = Mesh([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])
plane_3pt_3 = Plane3Pt(PointA=point_8, PointB=point_9, PointC=point_7)
orient_2 = Orient(Geometry=mesh_2, Source=plane_3pt_3, Target=PlaneXY(0, 0, 0))  # -> Geometry, Transform
xy_plane = XYPlane(Origin=Point(0, 0, 0))
scale_2 = Scale(Geometry=orient_2.Geometry, Center=Point(0, 0, 0), Factor="0.001")  # -> Geometry, Transform
python_3_script_5 = Python3Script(name="AssemblyTool", tool_visual_meshes=scale_2.Geometry, tool_collision_meshes=scale_2.Geometry, tool_frame=xy_plane)  # -> out, tool_model; inputs tool_visual_meshes: list of Mesh, tool_collision_meshes: list of Mesh, tool_frame: Plane; same code as python_3_script_4

boolean_toggle = BooleanToggle(True)

# ----
# Dual-arm Husky
load_robot_2 = Button()
python_3_script_6 = Python3Script(
    load=load_robot_2,
    pkg_path=panel,
    pkg_name="mt_husky_dual_ur5_e_moveit_config",
    urdf_file="husky_dual_ur5_e_no_base_joint.urdf",
    srdf_file="dual_arm_husky.srdf")  # -> out, robot_model, robot_semantics
# ---------- python_3_script_6: Python ----------
from scriptcontext import sticky as st
import os
import compas

from compas_robots import RobotModel
from compas_robots.resources import GithubPackageMeshLoader
from compas_robots.resources import LocalPackageMeshLoader
from compas_robots.ghpython.scene import RobotModelObject
# from compas_fab.robots import Robot
from compas_fab.robots import RobotSemantics
# from compas_ghpython.artists import RobotModelArtist

# Robot meshes are usually in meters
# Set a high percision to prevent parsing errors
# and configure Rhino itself in meters
compas.PRECISION = '12f'

# Store robot in component-based key
# ghenv.Component.InstanceGuid
robot_key = 'robot_{}'.format(str('dual-arm_husky_Cindy'))

if robot_key not in st:
    st[robot_key] = None

loader = LocalPackageMeshLoader(os.path.join(pkg_path), pkg_name)

if load:
# if True:
    # Also load geometry
    husky_loader = LocalPackageMeshLoader(os.path.join(pkg_path), "husky_description")
    dualarm_husky_loader = LocalPackageMeshLoader(os.path.join(pkg_path), "husky_ur_description")
    ur_loader = LocalPackageMeshLoader(os.path.join(pkg_path), "ur_description")
    
    # Create robot model from URDF
    model = RobotModel.from_urdf_string(loader.load_urdf(urdf_file).read())
    model.load_geometry(loader, husky_loader, dualarm_husky_loader, ur_loader)
    print(model)

    # # artist = RobotModelArtist(model)
    # scene_object = RobotModelObject(item=model)

    # # robot = Robot(model)
    # robot = Robot(model, scene_object, semantics=robot_semantics)
##    robot.scale(1000)
    st[robot_key] = model

robot_model = st[robot_key]
robot_semantics = None
if srdf_file:
    robot_semantics = RobotSemantics.from_srdf_file(loader.build_path('config', srdf_file), robot_model)


#repo    = 'ros-industrial/abb'
#package = 'abb_irb6600_support'
#branch  = 'kinetic-devel'
#
#github = GithubPackageMeshLoader(repo, package, branch)
#
#model = RobotModel.from_urdf_file(github.load_urdf('irb6640.urdf'))
#model.load_geometry(github)
#artist = RobotModelArtist(model)
#robot = Robot(model, artist)
# ---------- end python_3_script_6 ----------

construct_point = ConstructPoint(XCoordinate=number_slider, YCoordinate=0, ZCoordinate=number_slider)
construct_plane = ConstructPlane(Origin=construct_point, XAxis=Vector(1, 0, 0), YAxis=Vector(0, 1, 0))
python_3_script_7 = Python3Script(
    robot_model=python_3_script_6.robot_model,
    robot_semantics=python_3_script_6.robot_semantics,
    support_robot_model=python_3_script_3.robot_model,
    assembly_tool=python_3_script_5.tool_model,
    support_tool=python_3_script_4.tool_model,
    object_frame=construct_plane,
    is_hidden=Toggle(False))  # -> out, robot_cell, robot_cell_state; inputs rigid_bodies: list, object_frame: Plane
# ---------- python_3_script_7: Python ----------
#aasss venv: compas_fab_dev

from compas_fab.robots import RobotCell
from compas_fab.robots import RobotCellState
from compas_fab.robots import RigidBodyState
from compas.geometry import Box
from compas.geometry import Frame
from compas_rhino.conversions import plane_to_compas_frame

from compas_fab.robots import RobotCellLibrary
from compas_robots import ToolModel

robot_cell = RobotCell(robot_model, robot_semantics)

robot_cell.tool_models['Alice'] = ToolModel.from_robot_model(support_robot_model.copy(), Frame.worldXY())
robot_cell.tool_models['Belle'] = ToolModel.from_robot_model(support_robot_model.copy(), Frame.worldXY())

robot_cell.tool_models['AL'] = assembly_tool.copy()
robot_cell.tool_models['AR'] = assembly_tool.copy()

#################
robot_cell.tool_models['SGAlice'] = support_tool.copy()
robot_cell.tool_models['SGBelle'] = support_tool.copy()

#################
robot_cell_state = robot_cell.default_cell_state()

robot_cell_state.tool_states['AL'].attached_to_group = 'base_left_arm_manipulator'
robot_cell_state.tool_states['AL'].touch_links = ['left_ur_arm_wrist_3_link']

robot_cell_state.tool_states['AR'].attached_to_group = 'base_right_arm_manipulator'
robot_cell_state.tool_states['AR'].touch_links = ['right_ur_arm_wrist_3_link']

# if (rigid_bodies):
#     # Make sure RBs have unique names
#     assert len(set([rb.name for rb in rigid_bodies])) == len(rigid_bodies)
#     for rb in rigid_bodies:
#         assert rb.name
#         robot_cell.rigid_body_models[rb.name] = rb
#         robot_cell_state.rigid_body_states[rb.name] = RigidBodyState(
#             plane_to_compas_frame(object_frame),
#             is_hidden=is_hidden,
#         )

from compas.scene import Scene
scene = Scene()
scene.add(robot_cell)
# ---------- end python_3_script_7 ----------

visualization_scale = Slider(1.5, range=0..2)
python_3_script_8 = Python3Script(draw_collision=Toggle(False), draw_visual=Toggle(True), scale="0.001")  # -> out, options; inputs scale: Double
# ---------- python_3_script_8: Python ----------
from compas.data import Data
class RobotCellVisualizationOptions(Data):
    def __init__(self, draw_collision, draw_visual, scale):
        super(RobotCellVisualizationOptions, self).__init__()
        self.draw_collision = draw_collision
        self.draw_visual = draw_visual
        self.native_scale = scale

    @property
    def __data__(self):
        data = {
            'draw_collision': self.draw_collision,
            'draw_visual': self.draw_visual,
            'native_scale': self.native_scale,
            }
        return data

options = RobotCellVisualizationOptions(draw_collision, draw_visual, scale)

print(options.sha256(True))
# ---------- end python_3_script_8 ----------

boolean_toggle_2 = BooleanToggle(False)
data = Data(python_3_script_7.robot_cell)
data_2 = Data(python_3_script_7.robot_cell_state)
python_3_script_9 = Python3Script(robot_cell_state=data_2)  # -> out, a
# ---------- python_3_script_9: Python ----------
new_robot_cell_state = robot_cell_state
print(new_robot_cell_state.robot_configuration.joint_names)
# ---------- end python_3_script_9 ----------
panel_3 = Panel(python_3_script_9.out)
vector_xyz = VectorXYZ(XComponent=Slider(0.2, range=-10..10), YComponent=Slider(0, range=-10..10), ZComponent=Slider(0.3, range=-10..10))  # -> Vector, Length
pi = Pi(Factor=Slider(0.5, range=-1..1))
pi_2 = Pi(Factor=Slider(0, range=-1..1))
unit_y = UnitY(Factor=1)
unit_x = UnitX(Factor=1)

# ---- group: jaw_center_from_tool0
point_10 = Point(Point(-8.330831417e-05, 0.09375, -0.09747390072))
point_11 = Point(Point(-8.330831417e-05, 0.09375, -0.003398979218))
point_12 = Point(Point(0.1825777231, 0.09375, -0.003398979218))
xy_plane_2 = XYPlane(Origin=Point(0, 0, 0))
plane_3pt_4 = Plane3Pt(PointA=point_11, PointB=point_10, PointC=point_12)
python_3_script_10 = Python3Script(plane_a=xy_plane_2, plane_b=plane_3pt_4)  # -> out, bar_grasp_from_tool0
# ---------- python_3_script_10: Python ----------
# Inputs: plane_a, plane_b (both should be Rhino.Geometry.Plane)
# Output: T (compas.geometry.Transformation)

from compas.geometry import Frame, Transformation
from compas_rhino.conversions import plane_to_compas_frame
from compas_rhino.conversions import transformation_to_rhino

# Convert Rhino planes to COMPAS frames
frame_a = plane_to_compas_frame(plane_a)
frame_b = plane_to_compas_frame(plane_b)

# Compute the transformation from frame_a to frame_b
bar_grasp_from_tool0 = Transformation.from_frame_to_frame(frame_a, frame_b)
ghT = transformation_to_rhino(bar_grasp_from_tool0)
# ---------- end python_3_script_10 ----------

# ---- group: manually labeled assembly sequence here
data_3 = Data(Tree({0}: [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, "G"], {1}: [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, "G"], {2}: [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, "A"], {3}: [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, "A"], {4}: [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, "S"], {5}: [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, "S4"]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))

# ----
panel_4 = Panel(data_3)

# ---- group: tool at orign for grasping
block_instance = BlockInstance(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)

# ----
clean_tree = CleanTree(RemoveNulls=True, RemoveInvalid=True, RemoveEmpty=True, Tree=data_3)
list_item = ListItem(List=clean_tree, Index=0, Wrap=True)  # -> Item, Item1
brep = Brep(list_item.Item)
cap_holes = CapHoles(Brep=brep)

# ---- group: extract bar centroid frame from breps
volume = Volume(Geometry=cap_holes)  # -> Volume, Centroid
deconstruct_brep = DeconstructBrep(Brep=cap_holes)  # -> Faces, Edges, Vertices
list_item_2 = ListItem(List=deconstruct_brep.Edges, Index=0, Wrap=True)  # -> Item, Item1
xy_plane_3 = XYPlane(Origin=Point(0, 0, 0))
vector = Vector(list_item_2.Item1)
python_3_script_11 = Python3Script(vec=vector, pt=volume.Centroid)  # -> out, simplify(pln); inputs vec: Vector3d, pt: Point3d
# ---------- python_3_script_11: Python ----------
import Rhino.Geometry as rg

# Ensure the input vector is not zero
if vec.IsZero:
    raise ValueError("Input vector cannot be zero.")

# Normalize the input vector to use as Z axis
z_axis = vec
z_axis.Unitize()

# Choose an arbitrary vector not parallel to z_axis for cross product
if abs(z_axis.X) < 0.9:
    temp = rg.Vector3d(1, 0, 0)
else:
    temp = rg.Vector3d(0, 1, 0)

# X axis is perpendicular to Z and temp
x_axis = rg.Vector3d.CrossProduct(temp, z_axis)
x_axis.Unitize()

# Y axis is perpendicular to Z and X
y_axis = rg.Vector3d.CrossProduct(z_axis, x_axis)
y_axis.Unitize()

# Construct the plane
pln = rg.Plane(pt, x_axis, y_axis)
# ---------- end python_3_script_11 ----------
orient_3 = Orient(Geometry=cap_holes, Source=python_3_script_11.pln, Target=xy_plane_3)  # -> simplify(Geometry), Transform
mesh_3 = Mesh(orient_3.Geometry)

# ----
plane = Plane(flatten(python_3_script_11.pln))

# ---- group: grasp
# Step 7: select grasps
grasp_offset = Slider(-0.16, range=-0.5..0.5)
grasp_theta = Slider(0.015, range=0..4)
grasp_offset_2 = Slider(0.18, range=-0.5..0.5)
pi_3 = Pi(Factor="0.5")
multiplication = Multiplication(A=pi_3, B=grasp_theta)

# ----
data_4 = Data(data_2)
data_5 = Data(data)

# ---- group: bar_grasp_from_tool0
data_6 = Data(python_3_script_10.bar_grasp_from_tool0)

# ---- group: assembly stage
# Step 2: select assembly stage
assembly_stage = Slider(5, range=0..16)
_0_start_1_end = Slider(1, range=0..1)

# ----
list_item_3 = ListItem(List=plane, Index=assembly_stage, Wrap=True)
move = Move(Geometry=list_item_3, Motion=vector_xyz.Vector)  # -> Geometry, Transform
deconstruct_plane = DeconstructPlane(Plane=move.Geometry)  # -> Origin, XAxis, YAxis, ZAxis
rotate_3d = Rotate3D(Geometry=move.Geometry, Angle=pi, Center=deconstruct_plane.Origin, Axis=deconstruct_plane.YAxis)  # -> Geometry, Transform
rotate_3d_2 = Rotate3D(Geometry=rotate_3d.Geometry, Angle=pi_2, Center=deconstruct_plane.Origin, Axis=unit_y)  # -> Geometry, Transform
replace_items = ReplaceItems(List=plane, Item=rotate_3d_2.Geometry, Indices=assembly_stage, Wrap=False)  # -> simplify(graft(List))
stream_filter = StreamFilter(Gate=_0_start_1_end, Stream0=replace_items, Stream1=python_3_script_11.pln)

# ---- group: bar object frame
construct_path = ConstructPath(Indices=assembly_stage)
tree_branch = TreeBranch(Tree=stream_filter, Path=construct_path, MaintainPaths=True)

# ---- group: flip bar pose - should be turn into a grasp parameter later
deconstruct_plane_2 = DeconstructPlane(Plane=tree_branch)  # -> Origin, XAxis, YAxis, ZAxis
move_2 = Move(Geometry=deconstruct_plane_2.Origin, Motion=deconstruct_plane_2.XAxis)  # -> Geometry, Transform
line = Line(StartPoint=deconstruct_plane_2.Origin, EndPoint=move_2.Geometry)
pi_4 = Pi(Factor=1)
rotate_axis = RotateAxis(Geometry=tree_branch, Angle=pi_4, Axis=line)  # -> Geometry, Transform
plane_2 = Plane(rotate_axis.Geometry)

# ----
tree_branch_2 = TreeBranch(Tree=cap_holes, Path=construct_path, MaintainPaths=True)
python_3_script_12 = Python3Script(base_robot_cell=data_5, base_robot_cell_state=data_4, geometry_tree=mesh_3, frame_tree=stream_filter)  # -> out, result_tree, rigid_body_ids; inputs geometry_tree: tree of Mesh, frame_tree: tree
# ---------- python_3_script_12: Python ----------
"""
Grasshopper RobotCellState Processor

This script processes Grasshopper tree data containing geometry and frames
to create RobotCellState objects with proper temporal sequencing.
"""

import Rhino.Geometry as rg
from compas_fab.robots import RobotCell, RobotCellState, RigidBody, RigidBodyState, RobotCellLibrary
from compas.geometry import Box, Frame
from compas_rhino.conversions import mesh_to_compas, plane_to_compas_frame
from compas.scene import Scene
import ghpythonlib.treehelpers as th


def create_rigid_body_from_mesh(mesh, name):
    # # Convert Brep to mesh for visualization and collision
    # mesh_params = rg.MeshingParameters.Default
    # meshes = rg.Mesh.CreateFromBrep(brep, mesh_params)
    
    visuals = []
    collisions = []
    
    # for mesh in meshes:
    #     if mesh:
    compas_mesh = mesh_to_compas(mesh)
    visuals.append(compas_mesh)
    collisions.append(compas_mesh)
    
    rigid_body = RigidBody(visuals, collisions)
    rigid_body.name = name
    return rigid_body


def process_gh_tree_data(geometry_tree, frame_tree, base_robot_cell, base_robot_cell_state):
    """
    Process Grasshopper tree data to create RobotCellState objects with temporal sequencing.
    
    Args:
        geometry_tree: Grasshopper tree containing Brep geometries at origin
        frame_tree: Grasshopper tree containing world coordinate frames
        base_robot_cell: Optional base robot cell, if None will use ABB IRB4600
        
    Returns:
        DataTree: Grasshopper tree containing RobotCellState objects
    """
    # Convert trees to Python lists for easier processing
    geometry_data = th.tree_to_list(geometry_tree, lambda x:x)
    frame_data = th.tree_to_list(frame_tree, lambda x:x)
    
    # Ensure both trees have the same structure
    if len(geometry_data) != len(frame_data):
        raise ValueError("Geometry and frame trees must have the same structure")
    
    # Initialize base robot cell if not provided
    # if base_robot_cell_state is None:
    #     _, default_robot_cell_state = RobotCellLibrary.abb_irb4600_40_255_gripper_one_beam()
    # else:
    #     default_robot_cell_state = base_robot_cell_state
    robot_cell = base_robot_cell
    # robot_cell_state = base_robot_cell_state

    # Create a list to store all rigid bodies for naming
    all_rigid_bodies = []
    
    # First pass: create all rigid bodies
    for branch_idx, (geometry_branch, frame_branch) in enumerate(zip(geometry_data, frame_data)):
        # TODO: item_idx can be used for specifying bar geo and joint geos
        for item_idx, (geometry, frame) in enumerate(zip(geometry_branch, frame_branch)):
            if geometry and frame:
                # Create unique name for the rigid body
                body_name = f"b{branch_idx}_{item_idx}"
                rigid_body = create_rigid_body_from_mesh(geometry, body_name)
                all_rigid_bodies.append((rigid_body, branch_idx, item_idx))
    
    # Add all rigid bodies to the robot cell
    for rigid_body, _, _ in all_rigid_bodies:
        robot_cell.rigid_body_models[rigid_body.name] = rigid_body
    
    # Second pass: create RobotCellState for each temporal step
    robot_cell_states = []
    
    for current_step in range(len(geometry_data)):
        # Create a new robot cell state
        robot_cell_state = base_robot_cell_state.copy()
        
        # Set up rigid body states for this temporal step
        for rigid_body, temporal_step, item_idx in all_rigid_bodies:
            if temporal_step <= current_step:
                # This object has appeared or is current - use its world frame
                geometry_branch = geometry_data[temporal_step]
                frame_branch = frame_data[temporal_step]
                
                if item_idx < len(frame_branch) and frame_branch[item_idx]:
                    world_frame = plane_to_compas_frame(frame_branch[item_idx])
                    is_hidden = False
                else:
                    # Fallback to origin if frame is missing
                    world_frame = Frame.worldXY()
                    is_hidden = False
            else:
                # This object hasn't appeared yet - place it far away and hide it
                world_frame = Frame.worldXY()
                world_frame.point.z = 10  # Move far away

                # TODO hidden is not working properly with PybulletClient
                is_hidden = False
            
            robot_cell_state.rigid_body_states[rigid_body.name] = RigidBodyState(
                world_frame,
                is_hidden=is_hidden
            )
        
        robot_cell_states.append(robot_cell_state)
    
    # Convert back to Grasshopper tree structure
    result_tree = th.list_to_tree(robot_cell_states)
    return result_tree, robot_cell_states[0].rigid_body_ids


def create_scene_from_robot_cell_state(robot_cell, robot_cell_state):
    """
    Create a COMPAS scene from a RobotCellState for visualization.
    
    Args:
        robot_cell: The RobotCell containing the models
        robot_cell_state: The RobotCellState containing the poses
        
    Returns:
        Scene: COMPAS scene object
    """
    scene = Scene()
    scene.add(robot_cell, robot_cell_state)
    return scene

# try:
result_tree, rigid_body_ids = process_gh_tree_data(geometry_tree, frame_tree, base_robot_cell, base_robot_cell_state)
# except Exception as e:
#     print(f"Error processing tree data: {str(e)}")
# ---------- end python_3_script_12 ----------
list_item_4 = ListItem(List=python_3_script_12.rigid_body_ids, Index=assembly_stage, Wrap=True)
plane_3 = Plane(tree_branch)
panel_5 = Panel(list_item_4)
tree_branch_3 = TreeBranch(Tree=list_item.Item1, Path=construct_path, MaintainPaths=True)
deconstruct_plane_3 = DeconstructPlane(Plane=plane_2)  # -> Origin, XAxis, YAxis, ZAxis
list_item_5 = ListItem(List=python_3_script_12.result_tree, Index=assembly_stage, Wrap=True)
orient_4 = Orient(Geometry=block_instance, Source=PlaneXY(0, 0, 0), Target=plane_2)  # -> Geometry, Transform
rotate = Rotate(Geometry=orient_4.Geometry, Angle=multiplication, Plane=plane_2)  # -> Geometry, Transform

# ---- group: mobile base position
base_x = Slider(-1.47, range=-2..2)
base_y = Slider(0.1, range=-2..2)
yaw = Slider(5.995, range=0..6.283)
unit_x_2 = UnitX(Factor=1)
unit_y_2 = UnitY(Factor=1)
construct_point_2 = ConstructPoint(XCoordinate=base_x, YCoordinate=base_y, ZCoordinate=0)
rotate_2 = Rotate(Geometry=[unit_x_2, unit_y_2], Angle=yaw, Plane=PlaneXY(0, 0, 0))  # -> Geometry, Transform
list_item_6 = ListItem(List=rotate_2.Geometry, Index=0, Wrap=True)  # -> Item, Item1
construct_plane_2 = ConstructPlane(Origin=construct_point_2, XAxis=list_item_6.Item, YAxis=list_item_6.Item1)

# ----
multiplication_2 = Multiplication(A=deconstruct_plane_3.ZAxis, B=grasp_offset_2)
multiplication_3 = Multiplication(A=deconstruct_plane_3.ZAxis, B=grasp_offset)

# ---- group: joint conf initial guess
gene_pool = GenePool(Decimals=2, Maximum=3.14, Minimum=-3.14, Value=[-0.38, -0.66, -1.88, -2.5, -2.31, -0.53])
gene_pool_2 = GenePool(Decimals=2, Maximum=3.14, Minimum=-3.14, Value=[-1.52, -0.77, 0.4, -1.71, 2.19, -0.1])
merge = Merge(Data1=gene_pool_2, Data2=gene_pool)

# ----
move_3 = Move(Geometry=rotate.Geometry, Motion=multiplication_2)  # -> Geometry, Transform
move_4 = Move(Geometry=rotate.Geometry, Motion=multiplication_3)  # -> Geometry, Transform

python_3_script_13 = Python3Script(draw_collision=Toggle(False), draw_visual=Toggle(True))  # -> out, options
# ---------- python_3_script_13: Python ----------
from compas.data import Data
class RobotCellVisualizationOptions(Data):
    def __init__(self, draw_collision, draw_visual, scale):
        super(RobotCellVisualizationOptions, self).__init__()
        self.draw_collision = draw_collision
        self.draw_visual = draw_visual
        self.scale = scale

    @property
    def __data__(self):
        data = {
            'draw_collision': self.draw_collision,
            'draw_visual': self.draw_visual,
            'scale': self.scale,
            }
        return data

options = RobotCellVisualizationOptions(draw_collision, draw_visual, scale)

print(options.sha256(True))
# ---------- end python_3_script_13 ----------

merge_2 = Merge(Data1=rotate.Transform, Data2=move_4.Transform)
merge_3 = Merge(Data1=rotate.Transform, Data2=move_3.Transform)
compound = Compound(Transforms=merge_2)
plane_4 = Plane(plane_2)
python_3_script_14 = Python3Script(robot_cell_state=list_item_5, joint_values=merge, base_frame=construct_plane_2)  # -> out, new_robot_cell_state; inputs joint_values: list of Double, base_frame: Plane
# ---------- python_3_script_14: Python ----------
# BUG: this will lose all object data
# new_robot_cell_state = robot_cell_state.copy()

new_robot_cell_state = robot_cell_state.copy()
for i, joint_value in enumerate(joint_values):
    new_robot_cell_state.robot_configuration.joint_values[i] = joint_value

from compas_rhino.conversions import plane_to_compas_frame

new_robot_cell_state.robot_base_frame = plane_to_compas_frame(base_frame)

print(new_robot_cell_state.rigid_body_ids) #states['b0'].frame)
# ---------- end python_3_script_14 ----------

base_x_2 = Slider(-1.28, range=-2..2)
base_y_2 = Slider(-1.18, range=-2..2)
yaw_2 = Slider(1.006, range=0..6.283)
unit_x_3 = UnitX(Factor=1)
unit_y_3 = UnitY(Factor=1)
construct_point_3 = ConstructPoint(XCoordinate=base_x_2, YCoordinate=base_y_2, ZCoordinate=0)
gene_pool_3 = GenePool(Decimals=2, Maximum=3.14, Minimum=-3.14, Value=[1.13, -1.1, 0.4, 0.77, 1.46, 0.01])
rotate_3 = Rotate(Geometry=[unit_x_3, unit_y_3], Angle=yaw_2, Plane=PlaneXY(0, 0, 0))  # -> Geometry, Transform
list_item_7 = ListItem(List=rotate_3.Geometry, Index=0, Wrap=True)  # -> Item, Item1
merge_4 = Merge(Data1=gene_pool_3)
construct_plane_3 = ConstructPlane(Origin=construct_point_3, XAxis=list_item_7.Item, YAxis=list_item_7.Item1)
python_3_script_15 = Python3Script(
    robot_cell=python_3_script_7.robot_cell,
    robot_cell_state=python_3_script_14.new_robot_cell_state,
    tool_name="Alice",
    joint_values=merge_4,
    base_frame=construct_plane_3)  # -> out, new_robot_cell_state; inputs joint_values: list of Double, base_frame: Plane
# ---------- python_3_script_15: Python ----------
# BUG: this will lose all object data
# new_robot_cell_state = robot_cell_state.copy()
from compas.geometry import Transformation, Frame

new_robot_cell_state = robot_cell_state.copy()
for i, joint_value in enumerate(joint_values):
    new_robot_cell_state.tool_states[tool_name].configuration.joint_values[i] = joint_value

from compas_rhino.conversions import plane_to_compas_frame

new_robot_cell_state.tool_states[tool_name].frame = world_from_base_frame = plane_to_compas_frame(base_frame)
world_from_base = Transformation.from_frame(world_from_base_frame)

tool_robot_model = robot_cell.tool_models[tool_name]

base_from_tool0_frame = Transformation.from_frame(
    tool_robot_model.forward_kinematics(new_robot_cell_state.tool_states[tool_name].configuration, link_name='ur_arm_tool0')
    )
world_from_tool0_frame = Frame.from_transformation(world_from_base * base_from_tool0_frame)
new_robot_cell_state.tool_states[f'SG{tool_name}'].frame = world_from_tool0_frame
# ---------- end python_3_script_15 ----------

base_x_3 = Slider(-0.61, range=-2..2)
base_y_3 = Slider(2, range=-2..2)
yaw_3 = Slider(2.65, range=0..6.283)
unit_x_4 = UnitX(Factor=1)
unit_y_4 = UnitY(Factor=1)
construct_point_4 = ConstructPoint(XCoordinate=base_x_3, YCoordinate=base_y_3, ZCoordinate=0)
gene_pool_4 = GenePool(Decimals=2, Maximum=3.14, Minimum=-3.14, Value=[-1.42, -2.15, -1.95, -1.75, 2.19, -0.1])
rotate_4 = Rotate(Geometry=[unit_x_4, unit_y_4], Angle=yaw_3, Plane=PlaneXY(0, 0, 0))  # -> Geometry, Transform
list_item_8 = ListItem(List=rotate_4.Geometry, Index=0, Wrap=True)  # -> Item, Item1
merge_5 = Merge(Data1=gene_pool_4)
construct_plane_4 = ConstructPlane(Origin=construct_point_4, XAxis=list_item_8.Item, YAxis=list_item_8.Item1)
python_3_script_16 = Python3Script(
    robot_cell=python_3_script_7.robot_cell,
    robot_cell_state=python_3_script_15.new_robot_cell_state,
    tool_name="Belle",
    joint_values=merge_5,
    base_frame=construct_plane_4)  # -> out, new_robot_cell_state; inputs joint_values: list of Double, base_frame: Plane; same code as python_3_script_15

data_7 = Data(python_3_script_16.new_robot_cell_state)
compound_2 = Compound(Transforms=merge_3)
data_8 = Data(data_5)
transform = Transform(Geometry=plane_4, Transform=compound_2)
transform_2 = Transform(Geometry=plane_4, Transform=compound)

# ---- group: design study path
data_9 = Data(python_3_script_2.design_study_path)

# ----
# Step 9: click compute IK, and reverse IK targets if needed
switch_arm_targets = BooleanToggle(False)
compute_ik = BooleanToggle(False)

python_3_script_17 = Python3Script(plane=transform, bar_grasp_from_tool0=data_6)  # -> out, plane_out
# ---------- python_3_script_17: Python ----------
# Inputs: plane (Rhino.Geometry.Plane), T (compas.geometry.Transformation)
# Output: plane_out (Rhino.Geometry.Plane)

from compas_rhino.conversions import plane_to_compas_frame, frame_to_rhino_plane
from compas.geometry import Transformation, Frame

# Convert Rhino plane to COMPAS frame
frame = plane_to_compas_frame(plane)
world_from_bar_grasp = Transformation.from_frame(frame)

# Apply the transformation
# frame_transformed = frame.transformed(T)
world_from_tool0 = world_from_bar_grasp * bar_grasp_from_tool0

# Convert back to Rhino plane
plane_out = frame_to_rhino_plane(Frame.from_transformation(world_from_tool0))
# ---------- end python_3_script_17 ----------
python_3_script_18 = Python3Script(plane=transform_2, bar_grasp_from_tool0=data_6)  # -> out, plane_out
# ---------- python_3_script_18: Python ----------
# Inputs: plane (Rhino.Geometry.Plane), T (compas.geometry.Transformation)
# Output: plane_out (Rhino.Geometry.Plane)

from compas_rhino.conversions import plane_to_compas_frame, frame_to_rhino_plane
from compas.geometry import Transformation, Frame

# Convert Rhino plane to COMPAS frame
frame = plane_to_compas_frame(plane)
world_from_bar_grasp = Transformation.from_frame(frame)

# Apply the transformation
# frame_transformed = frame.transformed(T)
world_from_tool0 = world_from_bar_grasp * bar_grasp_from_tool0

# Convert back to Rhino plane
print(Frame.from_transformation(world_from_tool0))
plane_out = frame_to_rhino_plane(Frame.from_transformation(world_from_tool0))
# ---------- end python_3_script_18 ----------
plane_5 = Plane(python_3_script_17.plane_out)
plane_6 = Plane(python_3_script_18.plane_out)

# ---- group: dual arm
# Step 3: click connect dual arm
boolean_toggle_3 = BooleanToggle(True)
connect_dual_arm = Button()
python_3_script_19 = Python3Script(trigger=connect_dual_arm, robot_cell=data, use_gui=boolean_toggle_3)  # -> out, client, planner
# ---------- python_3_script_19: Python ----------
from compas_fab.backends import PyBulletClient
from compas_fab.backends import PyBulletPlanner
import pybullet as p
from scriptcontext import sticky as st
from compas_ghpython import create_id

gh_component = ghenv.Component
sticky_id = create_id(gh_component, '__')
if sticky_id not in st:
    st[sticky_id] = None, None

if trigger:
    client = PyBulletClient(connection_type="gui" if use_gui else "direct", verbose=True)
    client.__enter__()

    # Use PyBullet debug mode by enabling the debug visualizer and optionally adding debug lines/info
    # This will show joint axes, link frames, and other debug info in the GUI
    if use_gui:
        pass
        # p.configureDebugVisualizer(p.COV_ENABLE_GUI, 1, physicsClientId=client.client_id)
        # p.configureDebugVisualizer(p.COV_ENABLE_SHADOWS, 1, physicsClientId=client.client_id)
        # p.configureDebugVisualizer(p.COV_ENABLE_WIREFRAME, 1, physicsClientId=client.client_id)

    planner = PyBulletPlanner(client)
    planner.set_robot_cell(robot_cell)
    st[sticky_id] = client, planner

client, planner = st[sticky_id]
# ---------- end python_3_script_19 ----------

# ---- group: LEFT tool0 target
geometry = Geometry(move_4.Geometry)

# ----
geometry_2 = Geometry(move_3.Geometry)
merge_6 = Merge(Data1=plane_6, Data2=plane_5)

disconnect_pybullet_client = Button()
remove_debug = Button()
python_3_script_20 = Python3Script(x=remove_debug)  # -> remove_all_debug
# ---------- python_3_script_20: Python ----------
import pybullet_planning as pp
pp.remove_all_debug()
# ---------- end python_3_script_20 ----------
python_3_script_21 = Python3Script(trigger=disconnect_pybullet_client)  # -> out
# ---------- python_3_script_21: Python ----------
import pybullet_planning as pp
if trigger:
    # client.__exit__()
    pp.disconnect()
# ---------- end python_3_script_21 ----------

number_slider_2 = Slider(0, range=0..1)
merge_7 = Merge(Data1=geometry, Data2=geometry_2)
python_3_script_22 = Python3Script(world_from_bar=plane_2, world_from_tool0=merge_6)  # -> out, target
# ---------- python_3_script_22: Python ----------
from compas.data import Data
class GraspTarget(Data):
    def __init__(self, target_type, **kwargs):
        super(GraspTarget, self).__init__()
        self.type = target_type
        for k, v in kwargs.items():
            setattr(self, k, v)

    @property
    def __data__(self):
        # Customize this to serialize all relevant attributes
        data = {'type': self.type}
        for k, v in self.__dict__.items():
            if k not in ['type', '_guid', '_name']:
                data[k] = v
        return data

    @classmethod
    def __from_data__(cls, data):
        target_type = data.pop('type')
        return cls(target_type, **data)

from compas_rhino.conversions import plane_to_compas_frame, frame_to_rhino_plane
from compas.geometry import Transformation, Frame

def GHPlane_to_tf(plane):
    return Transformation.from_frame(plane_to_compas_frame(plane))

target = GraspTarget(
    "direct",
    world_from_bar=GHPlane_to_tf(world_from_bar),
    world_from_tool0=GHPlane_to_tf(world_from_tool0)
)
# ---------- end python_3_script_22 ----------
list_item_9 = ListItem(List=python_3_script_22.target, Index=number_slider_2, Wrap=True)  # -> Item, Item1
list_item_10 = ListItem(List=merge_7, Index=number_slider_2, Wrap=True)  # -> Item, Item1
merge_8 = Merge(Data1=list_item_9.Item, Data2=list_item_9.Item1)  # -> flatten(Result)

# ---- group: passing a robot cell state into pybullet client
python_3_script_23 = Python3Script(planner=python_3_script_19.planner, robot_cell_state=data_7)  # -> out, planner
# ---------- python_3_script_23: Python ----------
import pybullet_planning as pp
from compas.geometry import Frame, Transformation

def pose_from_frame(frame, scale=1.0):
    return ([v*scale for v in frame.point], frame.quaternion.xyzw)

def frame_from_pose(pose, scale=1.0):
    point, (x, y, z, w) = pose
    return Frame.from_quaternion([w, x, y, z], point=[v*scale for v in point])

planner.set_robot_cell_state(robot_cell_state)
robot_base_frame = robot_cell_state.robot_base_frame
robot_base_pose = pose_from_frame(robot_base_frame)
pp.set_pose(planner.client.robot_puid, robot_base_pose)
# ---------- end python_3_script_23 ----------

# ----
reverse_list = ReverseList(List=merge_8)
check_collisions = BooleanToggle(False)
stream_filter_2 = StreamFilter(Gate=switch_arm_targets, Stream0=merge_8, Stream1=reverse_list)
python_3_script_24 = Python3Script(target=stream_filter_2)  # -> out, plane
# ---------- python_3_script_24: Python ----------
# GHPython inputs: world_from_bar, world_from_tool0
# Output: target
from compas_rhino.conversions import frame_to_rhino_plane
from compas.geometry import Frame
plane = None
if target:
    plane = frame_to_rhino_plane(Frame.from_transformation(target.world_from_tool0))
# ---------- end python_3_script_24 ----------
plane_7 = Plane(python_3_script_24.plane)
plane_8 = Plane(flatten(plane_7))
merge_9 = Merge(Data1="base_left_arm_manipulator", Data2="base_right_arm_manipulator")

# ---- group: pb backend ik test
# tool-rigid body collisions?
python_3_script_25 = Python3Script(
    trigger=compute_ik,
    planner=python_3_script_23.planner,
    robot_cell_state=data_7,
    target_planes=plane_8,
    groups=merge_9,
    check_collision=check_collisions)  # -> out, new_robot_cell_state; inputs target_planes: list of Plane, groups: list
# ---------- python_3_script_25: Python ----------
from compas.geometry import Frame

from compas_fab.backends import PyBulletClient
from compas_fab.backends import PyBulletPlanner
from compas_fab.robots import FrameTarget
from compas_fab.robots import RobotCellLibrary
from compas_fab.robots import TargetMode
from compas_rhino.conversions import plane_to_compas_frame
import pybullet_planning as pp
import pybullet as p

from compas.geometry import Frame, Transformation

def pose_from_frame(frame, scale=1.0):
    return ([v*scale for v in frame.point], frame.quaternion.xyzw)

def frame_from_pose(pose, scale=1.0):
    point, (x, y, z, w) = pose
    return Frame.from_quaternion([w, x, y, z], point=[v*scale for v in point])

targets = []
for tp in target_planes:    
    target = FrameTarget(plane_to_compas_frame(tp), TargetMode.ROBOT)
    targets.append(target)
    pp.draw_pose(pose_from_frame(target.target_frame))

new_robot_cell_state = None

if trigger:
    print(planner.client._get_pose_joint_names_and_puids())

    options = {"max_results": 20, "check_collision": check_collision}
    new_robot_cell_state = robot_cell_state.copy()
    for target, group in zip(targets, groups):
        try:
        # if 1:
            config = planner.inverse_kinematics(
                target, 
                new_robot_cell_state, 
                group=group, 
                options=options
            )
        except Exception as e:
            print(f"IK failed for {group}: {e}")
            config = None

        if config is not None:
            # Only update the joints in this group
            group_joint_names = planner.client.robot_cell.get_configurable_joint_names(group)
            for joint_name, joint_value in zip(config.joint_names, config.joint_values):
                if joint_name in group_joint_names:
                    new_robot_cell_state.robot_configuration[joint_name] = joint_value

if new_robot_cell_state:
    planner.client._set_robot_configuration(new_robot_cell_state.robot_configuration)

print("Found configuration", new_robot_cell_state.robot_configuration)
# result_count += 1
# print("Found %d configurations" % result_count)
# ---------- end python_3_script_25 ----------

# ---- group: viz switcher
# Step 8: change viz mode to planned (1) to see the result in Rhino
viz_mode = Slider(0, range=0..1)
panel_6 = Panel("0:guess|1:planned")
python_3_script_26 = Python3Script(x=compute_ik, y=viz_mode)  # -> out, a
# ---------- python_3_script_26: Python ----------
a = 1 if x else y
# ---------- end python_3_script_26 ----------
stream_filter_3 = StreamFilter(Gate=python_3_script_26.a, Stream0=data_7, Stream1=python_3_script_25.new_robot_cell_state)

# ----
# Connect this to the right robot cell state
# you want to visualize!
data_10 = Data(stream_filter_3)

# ---- group: viz
python_3_script_27 = Python3Script(robot_cell=data_8, robot_cell_state=data_10, vis_options=python_3_script_13.options)  # -> out, draw, left_tool0_frame, right_tool0_frame
# ---------- python_3_script_27: Python ----------
#sss vsenv: compas_fab_dev

import scriptcontext as sc
from compas.scene import SceneObject
from compas.scene import Scene
from compas_rhino.conversions import frame_to_rhino_plane
from compas.geometry import Frame, Transformation

from compas_ghpython import create_id

# This script will leak memory due to unused and untracked sceneobject in sticky

debug = True
def debug_print(s):
    if debug:
        print(s)

# Create hash (scope limited to this component) for cacheing SceneObject
# The Data.sha256 function includes the guid of the compas object
#object_hash = object.sha256(as_string=True)
# The ID function is much faster than the sha256()
object_hash = str(id(robot_cell))
options_hash = vis_options.sha256(True)
# The ghenv.Component has a guid assigned by GH to each component instance
gh_component = ghenv.Component
sticky_id = create_id(gh_component, object_hash +"_"+ options_hash+str(single_arm))
debug_print("Cacheing ID: '{}'".format(sticky_id))

# If scene object exist in sticky
scene_object = None
if sc.sticky.has_key(sticky_id):
    scene_object = sc.sticky[sticky_id]
    # Double check if the item is the same
    if scene_object.item is robot_cell:
        debug_print("SceneObject '{}' reused for '{}'".format(type(scene_object).__name__, type(object).__name__))

# Create Scene Object
if scene_object is None:
    scene = Scene()
    kwargs = vis_options.__data__
    scene_object = scene.add(robot_cell, **kwargs)
    debug_print("SceneObject {} newly created for {}".format(type(scene_object).__name__, type(object).__name__))
    sc.sticky[sticky_id] = scene_object

# print(scene_object._scale)
draw = scene_object.draw(robot_cell_state)
world_from_base = Transformation.from_frame(robot_cell_state.robot_base_frame)
if not single_arm:
    base_from_left_tool0_frame = Transformation.from_frame(
        robot_cell.robot_model.forward_kinematics(robot_cell_state.robot_configuration, link_name='left_ur_arm_tool0'))
    left_tool0_frame = frame_to_rhino_plane(Frame.from_transformation(world_from_base * base_from_left_tool0_frame))

    base_from_right_tool0_frame = Transformation.from_frame(
        robot_cell.robot_model.forward_kinematics(robot_cell_state.robot_configuration, link_name='right_ur_arm_tool0'))
    right_tool0_frame = frame_to_rhino_plane(Frame.from_transformation(world_from_base * base_from_right_tool0_frame))
else:
    base_from_tool0_frame = Transformation.from_frame(
        robot_cell.robot_model.forward_kinematics(robot_cell_state.robot_configuration, link_name='ur_arm_tool0'))
    tool0_frame = frame_to_rhino_plane(Frame.from_transformation(world_from_base * base_from_tool0_frame))
# ---------- end python_3_script_27 ----------
draw = GhPythonScript(planes=[python_3_script_27.left_tool0_frame, python_3_script_27.right_tool0_frame], scale=Slider(0.1, range=0..1))  # -> P, V, C, W; inputs planes: list
# ---------- draw: Python ----------
from System.Drawing import Color

red = Color.FromArgb(255, 0, 0)
green = Color.FromArgb(0, 255, 0)
blue = Color.FromArgb(0, 0, 255)

P = []
V = []
C = []

scale = float(scale)

for plane in planes:
    if not plane:
        continue
    P += [plane.Origin] * 3
    V.append(plane.XAxis * scale)
    V.append(plane.YAxis * scale)
    V.append(plane.ZAxis * scale)
    C += [red, green, blue]

W = 3
# ---------- end draw ----------
vdisex = VectorDisplayEx(Point=draw.P, Vector=draw.V, Colour=draw.C, Width=draw.W)

# ----
panel_7 = Panel(python_3_script_25.out)
stream_filter_4 = StreamFilter(Gate=_0_start_1_end, Stream0="_start", Stream1="_end")
save_robot_cell_state_grasp_fast = Button()

# ---- group: export json
# Step 10: click the button to save the RobotCellState!
# but make sure you click the `save robot cell` button at least once (cell saving takes long compared to state)
# Saving GraspTargets
data_11 = Data(tree_branch_3)
concatenate = Concatenate(A="A", Fragment_A=assembly_stage, B="-", Fragment_B=data_11, C=stream_filter_4)
concatenate_2 = Concatenate(FragmentA="robotx_box_", FragmentB=concatenate)
panel_8 = Panel(concatenate_2)
data_12 = Data(stream_filter_2)
save_robot_cell_slow = Button()
python_3_script_28 = Python3Script(
    save_robot_cell=save_robot_cell_slow,
    save_state=save_robot_cell_state_grasp_fast,
    robot_cell=data,
    robot_cell_state=stream_filter_3,
    file_path=data_9,
    state_name=concatenate_2)  # -> out, a; inputs file_path: String, state_name: String
# ---------- python_3_script_28: Python ----------
# export_robotcell_to_json.py

import json, os
from compas import json_dump, json_load
from compas_fab.robots import RobotCell, RobotCellState

def export_robotcell_and_state(content, filepath, file_prefix=None):
    os.makedirs(filepath, exist_ok=True)  # Ensure directory exists

    content_class = type(content).__name__
    if file_prefix:
        file_name = f"{file_prefix}_{content_class}.json"
    else:
        file_name = f"{content_class}.json"

    full_path = os.path.join(filepath, file_name)
    
    with open(full_path, "w") as f:
        json_dump(content, f, pretty=True)

    print(f"Exported {content_class} to {full_path}")

# Example usage:
# robot_cell, robot_cell_state = ... (your objects)
if save_robot_cell and robot_cell is not None:
    export_robotcell_and_state(robot_cell, file_path)
if save_state and robot_cell_state is not None:
    export_robotcell_and_state(robot_cell_state, os.path.join(file_path, 'RobotCellStates'), state_name)
# ---------- end python_3_script_28 ----------
python_3_script_29 = Python3Script(save=save_robot_cell_state_grasp_fast, targets=data_12, file_path=data_9, state_name=concatenate_2)  # -> out, a; inputs targets: list
# ---------- python_3_script_29: Python ----------
import os
from compas.geometry import Transformation
from compas_rhino.conversions import plane_to_compas_frame
from compas import json_dump

def export_targets_to_json(targets, file_path, state_name=None):
    os.makedirs(file_path, exist_ok=True)  # Ensure directory exists

    if state_name:
        file_name = f"{state_name}_GraspTargets.json"
    else:
        file_name = "GraspTargets.json"

    out_path = os.path.join(file_path, file_name)
    with open(out_path, 'w') as f:
        json_dump(targets, f, pretty=True)

    print("Exported grasp targets to", out_path)

# Example usage
if save:
    export_targets_to_json(targets, os.path.join(file_path, 'RobotCellStates'), state_name)
# ---------- end python_3_script_29 ----------
panel_9 = Panel(python_3_script_28.out)

# ----
# Step 6: Save start state here!
panel_10 = Panel("_start_state")
save_state = Button()
concatenate_3 = Concatenate(FragmentA=concatenate_2, FragmentB=panel_10)
python_3_script_30 = Python3Script(save_state=save_state, robot_cell_state=stream_filter_3, file_path=data_9, state_name=concatenate_3)  # -> out, a; inputs file_path: String, state_name: String
# ---------- python_3_script_30: Python ----------
# export_robotcell_to_json.py

import json, os
from compas import json_dump, json_load
from compas_fab.robots import RobotCell, RobotCellState

def export_robotcellstate(content, filepath, file_prefix=None):
    content_class = type(content).__name__
    # print(content_class)
    file_name = '{}_{}.json'.format(file_prefix, content_class) if file_prefix else f'{content_class}.json'
    with open(os.path.join(filepath, file_name), "w") as f:
        json_dump(content, f, pretty=True)
        
    print(f"Exported {content_class} to {os.path.join(filepath, file_name)}")

if save_state and robot_cell_state is not None:
    export_robotcellstate(robot_cell_state, os.path.join(file_path, 'RobotCellStates'), state_name)
# ---------- end python_3_script_30 ----------
panel_11 = Panel(concatenate_3)

panel_12 = Panel(python_3_script_30.out)

# ----
# Example for parsing a grasp target from json
use_parsed_grasptargets = BooleanToggle(False)
python_3_script_31 = Python3Script(load=use_parsed_grasptargets, file_path=data_9, state_name=concatenate_2)  # -> out, grasp_targets
# ---------- python_3_script_31: Python ----------
import os
import json
from compas.data import Data
from compas.geometry import Transformation

class GraspTarget(Data):
    def __init__(self, target_type, **kwargs):
        super(GraspTarget, self).__init__()
        self.type = target_type
        for k, v in kwargs.items():
            setattr(self, k, v)

    @property
    def __data__(self):
        data = {'type': self.type}
        for k, v in self.__dict__.items():
            if k not in ['type', '_guid', '_name']:
                data[k] = v
        return data

    @classmethod
    def __from_data__(cls, data):
        target_type = data.pop('type')
        return cls(target_type, **data)

def parse_transformation(data):
    """Parse a transformation from a dict with a 'matrix' key."""
    if isinstance(data, dict) and 'matrix' in data:
        return Transformation(data['matrix'])
    return data

def parse_grasp_target_dict(d):
    """Parse a dict (from JSON) into a GraspTarget, converting transformations."""
    target_type = d.get('type')
    kwargs = {}
    for k, v in d.items():
        if k == 'type':
            continue
        # Handle nested 'data' for transformations
        if isinstance(v, dict) and v.get('dtype', '').endswith('Transformation'):
            kwargs[k] = parse_transformation(v['data'])
        else:
            kwargs[k] = v
    return GraspTarget(target_type, **kwargs)

import json
from compas import json_load, json_loads

def load_grasp_targets(file_path, state_name):
    in_path = os.path.join(file_path, 'RobotCellStates', state_name + '_GraspTargets.json')
    with open(in_path, 'r') as f:
        # targets = json_load(f)
        raw = json.load(f)

    # raw is a list of objects, each with a 'data' key
    targets = []
    for item in raw:
        data = item['data'] if 'data' in item else item
        targets.append(parse_grasp_target_dict(data))
        # this doesn't work since GraspTarget is not registered
        # targets.append(json_loads(json.dumps(data)))

    return targets

grasp_targets = None
if load:
    grasp_targets = load_grasp_targets(file_path, state_name)
# ---------- end python_3_script_31 ----------

data_13 = Data(concatenate_2)
data_14 = Data(concatenate_3)
panel_13 = Panel([data_13, data_14])

# ---- group: parse state
# Example for parsing a cell state
python_3_script_32 = Python3Script(x=viz_mode, file_path=data_9, state_name=data_13)  # -> out, robot_cell_state; inputs file_path: String, state_name: String
# ---------- python_3_script_32: Python ----------
import os
from compas import json_load

with open(os.path.join(file_path, 'RobotCellStates', '{}_{}.json'.format(state_name, 'RobotCellState')), "r") as f:
    robot_cell_state = json_load(f)
# ---------- end python_3_script_32 ----------
