# Grasshopper definition robot_cell.gh (Grasshopper 1.0.8)

panel = Panel("D:\0_Project\03-2025_husky_assembly\Code\husky-asembly-teleop\data\husky_urdf")

# ----
# Single-arm Husky
panel_2 = Panel("husky_ur5_e_no_base_joint.urdf")
load_robot = Button()
python_3_script = Python3Script(load=load_robot, pkg_path=panel, pkg_name="mt_husky_moveit_config", urdf_file=panel_2, srdf_file="husky.srdf")  # -> out, robot_model, robot_semantics
# ---------- python_3_script: Python ----------
from scriptcontext import sticky as st
import os
import compas

from compas_robots import RobotModel
from compas_robots.resources import GithubPackageMeshLoader
from compas_robots.resources import LocalPackageMeshLoader
from compas_robots.ghpython.scene import RobotModelObject
# from compas_fab.robots import Robot
from compas_fab.robots import RobotSemantics
# from compas_ghpython.artists import RobotModelArtist

# Robot meshes are usually in meters
# Set a high percision to prevent parsing errors
# and configure Rhino itself in meters
compas.PRECISION = '12f'

# Store robot in component-based key
# ghenv.Component.InstanceGuid
robot_key = 'robot_{}'.format(str('single-arm_husky_Alice'))

if robot_key not in st:
    st[robot_key] = None

loader = LocalPackageMeshLoader(os.path.join(pkg_path), pkg_name)

if load:
# if True:
    # Also load geometry
    husky_loader = LocalPackageMeshLoader(os.path.join(pkg_path), "husky_description")
    dualarm_husky_loader = LocalPackageMeshLoader(os.path.join(pkg_path), "husky_ur_description")
    ur_loader = LocalPackageMeshLoader(os.path.join(pkg_path), "ur_description")
    
    # Create robot model from URDF
    model = RobotModel.from_urdf_string(loader.load_urdf(urdf_file).read())
    model.load_geometry(loader, husky_loader, dualarm_husky_loader, ur_loader)
    print(model)

    # # artist = RobotModelArtist(model)
    # scene_object = RobotModelObject(item=model)

    # # robot = Robot(model)
    # robot = Robot(model, scene_object, semantics=robot_semantics)
##    robot.scale(1000)
    st[robot_key] = model

robot_model = st[robot_key]
robot_semantics = None
if srdf_file:
    robot_semantics = RobotSemantics.from_srdf_file(loader.build_path('config', srdf_file), robot_model)


#repo    = 'ros-industrial/abb'
#package = 'abb_irb6600_support'
#branch  = 'kinetic-devel'
#
#github = GithubPackageMeshLoader(repo, package, branch)
#
#model = RobotModel.from_urdf_file(github.load_urdf('irb6640.urdf'))
#model.load_geometry(github)
#artist = RobotModelArtist(model)
#robot = Robot(model, artist)
# ---------- end python_3_script ----------

number_slider = Slider(0.9, range=0..2)

point = Point(Point(0, 100, 0))
point_2 = Point(Point(0, 0, 0))
point_3 = Point(Point(100, 0, 0))
mesh = Mesh([<mesh referenced from the Rhino model> x4])
plane_3pt = Plane3Pt(PointA=point_2, PointB=point_3, PointC=point)
orient = Orient(Geometry=mesh, Source=plane_3pt, Target=PlaneXY(0, 0, 0))  # -> Geometry, Transform
point_4 = Point(Point(3.917690688e-09, 100, 166.1309561))
point_5 = Point(Point(3.917690688e-09, -8.756071423e-10, 166.1309561))
point_6 = Point(Point(100, -8.756071423e-10, 166.1309561))
scale = Scale(Geometry=orient.Geometry, Center=Point(0, 0, 0), Factor="0.001")  # -> Geometry, Transform
plane_3pt_2 = Plane3Pt(PointA=point_5, PointB=point_6, PointC=point_4)
python_3_script_2 = Python3Script(name="RobotiqGripper", tool_visual_meshes=scale.Geometry, tool_collision_meshes=scale.Geometry, tool_frame=plane_3pt_2)  # -> out, tool_model; inputs tool_visual_meshes: list of Mesh, tool_collision_meshes: list of Mesh, tool_frame: Plane
# ---------- python_3_script_2: Python ----------
from compas_robots import ToolModel
from compas.geometry import Transformation
from compas_rhino.conversions import plane_to_compas_frame, mesh_to_compas

cp_visual_meshes = [mesh_to_compas(vm) for vm in tool_visual_meshes]
cp_collision_meshes = [mesh_to_compas(vm) for vm in tool_collision_meshes]
cp_tool_frame = plane_to_compas_frame(tool_frame)

tool_model = ToolModel(None, cp_tool_frame, None, name)

tool_model.add_link("attached_tool_link", visual_meshes=cp_visual_meshes, collision_meshes=cp_collision_meshes)
tool_model._rebuild_tree()
tool_model._create(tool_model.root, Transformation())
# ---------- end python_3_script_2 ----------

point_7 = Point(Point(-45, 70, -109.75))
point_8 = Point(Point(-45, -30, -109.75))
point_9 = Point(Point(55, -30, -109.75))
mesh_2 = Mesh([<mesh referenced from the Rhino model> x7])
plane_3pt_3 = Plane3Pt(PointA=point_8, PointB=point_9, PointC=point_7)
orient_2 = Orient(Geometry=mesh_2, Source=plane_3pt_3, Target=PlaneXY(0, 0, 0))  # -> Geometry, Transform
xy_plane = XYPlane(Origin=Point(0, 0, 0))
scale_2 = Scale(Geometry=orient_2.Geometry, Center=Point(0, 0, 0), Factor="0.001")  # -> Geometry, Transform
python_3_script_3 = Python3Script(name="AssemblyTool", tool_visual_meshes=scale_2.Geometry, tool_collision_meshes=scale_2.Geometry, tool_frame=xy_plane)  # -> out, tool_model; inputs tool_visual_meshes: list of Mesh, tool_collision_meshes: list of Mesh, tool_frame: Plane; same code as python_3_script_2

boolean_toggle = BooleanToggle(True)

# ----
# Dual-arm Husky
load_robot_2 = Button()
python_3_script_4 = Python3Script(
    load=load_robot_2,
    pkg_path=panel,
    pkg_name="mt_husky_dual_ur5_e_moveit_config",
    urdf_file="husky_dual_ur5_e_no_base_joint.urdf",
    srdf_file="dual_arm_husky.srdf")  # -> out, robot_model, robot_semantics
# ---------- python_3_script_4: Python ----------
from scriptcontext import sticky as st
import os
import compas

from compas_robots import RobotModel
from compas_robots.resources import GithubPackageMeshLoader
from compas_robots.resources import LocalPackageMeshLoader
from compas_robots.ghpython.scene import RobotModelObject
# from compas_fab.robots import Robot
from compas_fab.robots import RobotSemantics
# from compas_ghpython.artists import RobotModelArtist

# Robot meshes are usually in meters
# Set a high percision to prevent parsing errors
# and configure Rhino itself in meters
compas.PRECISION = '12f'

# Store robot in component-based key
# ghenv.Component.InstanceGuid
robot_key = 'robot_{}'.format(str('dual-arm_husky_Cindy'))

if robot_key not in st:
    st[robot_key] = None

loader = LocalPackageMeshLoader(os.path.join(pkg_path), pkg_name)

if load:
# if True:
    # Also load geometry
    husky_loader = LocalPackageMeshLoader(os.path.join(pkg_path), "husky_description")
    dualarm_husky_loader = LocalPackageMeshLoader(os.path.join(pkg_path), "husky_ur_description")
    ur_loader = LocalPackageMeshLoader(os.path.join(pkg_path), "ur_description")
    
    # Create robot model from URDF
    model = RobotModel.from_urdf_string(loader.load_urdf(urdf_file).read())
    model.load_geometry(loader, husky_loader, dualarm_husky_loader, ur_loader)
    print(model)

    # # artist = RobotModelArtist(model)
    # scene_object = RobotModelObject(item=model)

    # # robot = Robot(model)
    # robot = Robot(model, scene_object, semantics=robot_semantics)
##    robot.scale(1000)
    st[robot_key] = model

robot_model = st[robot_key]
robot_semantics = None
if srdf_file:
    robot_semantics = RobotSemantics.from_srdf_file(loader.build_path('config', srdf_file), robot_model)


#repo    = 'ros-industrial/abb'
#package = 'abb_irb6600_support'
#branch  = 'kinetic-devel'
#
#github = GithubPackageMeshLoader(repo, package, branch)
#
#model = RobotModel.from_urdf_file(github.load_urdf('irb6640.urdf'))
#model.load_geometry(github)
#artist = RobotModelArtist(model)
#robot = Robot(model, artist)
# ---------- end python_3_script_4 ----------

construct_point = ConstructPoint(XCoordinate=number_slider, YCoordinate=0, ZCoordinate=number_slider)
construct_plane = ConstructPlane(Origin=construct_point, XAxis=Vector(1, 0, 0), YAxis=Vector(0, 1, 0))

# ---- group: mobile base position
base_x = Slider(1.27, range=-2..2)
base_y = Slider(0.28, range=-2..2)
yaw = Slider(3.54, range=0..6.283)
unit_x = UnitX(Factor=1)
unit_y = UnitY(Factor=1)
construct_point_2 = ConstructPoint(XCoordinate=base_x, YCoordinate=base_y, ZCoordinate=0)
rotate = Rotate(Geometry=[unit_x, unit_y], Angle=yaw, Plane=PlaneXY(0, 0, 0))  # -> Geometry, Transform
list_item = ListItem(List=rotate.Geometry, Index=0, Wrap=True)  # -> Item, Item1
construct_plane_2 = ConstructPlane(Origin=construct_point_2, XAxis=list_item.Item, YAxis=list_item.Item1)

# ----
python_3_script_5 = Python3Script(
    robot_model=python_3_script_4.robot_model,
    robot_semantics=python_3_script_4.robot_semantics,
    support_robot_model=python_3_script.robot_model,
    assembly_tool=python_3_script_3.tool_model,
    support_tool=python_3_script_2.tool_model,
    object_frame=construct_plane,
    is_hidden=Toggle(False))  # -> out, robot_cell, robot_cell_state; inputs rigid_bodies: list, object_frame: Plane
# ---------- python_3_script_5: Python ----------
#aasss venv: compas_fab_dev

from compas_fab.robots import RobotCell
from compas_fab.robots import RobotCellState
from compas_fab.robots import RigidBodyState
from compas.geometry import Box
from compas.geometry import Frame
from compas_rhino.conversions import plane_to_compas_frame

from compas_fab.robots import RobotCellLibrary
from compas_robots import ToolModel

robot_cell = RobotCell(robot_model, robot_semantics)

robot_cell.tool_models['Alice'] = ToolModel.from_robot_model(support_robot_model.copy(), Frame.worldXY())
robot_cell.tool_models['Belle'] = ToolModel.from_robot_model(support_robot_model.copy(), Frame.worldXY())

robot_cell.tool_models['AL'] = assembly_tool.copy()
robot_cell.tool_models['AR'] = assembly_tool.copy()

#################
robot_cell.tool_models['SGAlice'] = support_tool.copy()
robot_cell.tool_models['SGBelle'] = support_tool.copy()

#################
robot_cell_state = robot_cell.default_cell_state()

robot_cell_state.tool_states['AL'].attached_to_group = 'base_left_arm_manipulator'
robot_cell_state.tool_states['AL'].touch_links = ['left_ur_arm_wrist_3_link']

robot_cell_state.tool_states['AR'].attached_to_group = 'base_right_arm_manipulator'
robot_cell_state.tool_states['AR'].touch_links = ['right_ur_arm_wrist_3_link']

# if (rigid_bodies):
#     # Make sure RBs have unique names
#     assert len(set([rb.name for rb in rigid_bodies])) == len(rigid_bodies)
#     for rb in rigid_bodies:
#         assert rb.name
#         robot_cell.rigid_body_models[rb.name] = rb
#         robot_cell_state.rigid_body_states[rb.name] = RigidBodyState(
#             plane_to_compas_frame(object_frame),
#             is_hidden=is_hidden,
#         )

from compas.scene import Scene
scene = Scene()
scene.add(robot_cell)
# ---------- end python_3_script_5 ----------

visualization_scale = Slider(1.5, range=0..2)
python_3_script_6 = Python3Script(draw_collision=Toggle(False), draw_visual=Toggle(True), scale="0.001")  # -> out, options; inputs scale: Double
# ---------- python_3_script_6: Python ----------
from compas.data import Data
class RobotCellVisualizationOptions(Data):
    def __init__(self, draw_collision, draw_visual, scale):
        super(RobotCellVisualizationOptions, self).__init__()
        self.draw_collision = draw_collision
        self.draw_visual = draw_visual
        self.native_scale = scale

    @property
    def __data__(self):
        data = {
            'draw_collision': self.draw_collision,
            'draw_visual': self.draw_visual,
            'native_scale': self.native_scale,
            }
        return data

options = RobotCellVisualizationOptions(draw_collision, draw_visual, scale)

print(options.sha256(True))
# ---------- end python_3_script_6 ----------

# ---- group: joint conf initial guess
gene_pool = GenePool(Decimals=2, Maximum=3.14, Minimum=-3.14, Value=[-0.38, -0.66, -1.88, -2.5, -2.31, -0.53])
gene_pool_2 = GenePool(Decimals=2, Maximum=3.14, Minimum=-3.14, Value=[-1.52, -0.77, 0.4, -1.71, 2.19, -0.1])
merge = Merge(Data1=gene_pool_2, Data2=gene_pool)

# ----
python_3_script_7 = Python3Script(robot_cell_state=python_3_script_5.robot_cell_state, joint_values=merge, base_frame=construct_plane_2)  # -> out, new_robot_cell_state; inputs joint_values: list of Double, base_frame: Plane
# ---------- python_3_script_7: Python ----------
# BUG: this will lose all object data
# new_robot_cell_state = robot_cell_state.copy()

new_robot_cell_state = robot_cell_state.copy()
for i, joint_value in enumerate(joint_values):
    new_robot_cell_state.robot_configuration.joint_values[i] = joint_value

from compas_rhino.conversions import plane_to_compas_frame

new_robot_cell_state.robot_base_frame = plane_to_compas_frame(base_frame)

print(new_robot_cell_state.rigid_body_ids) #states['b0'].frame)
# ---------- end python_3_script_7 ----------

base_x_2 = Slider(1.42, range=-2..2)
base_y_2 = Slider(2, range=-2..2)
yaw_2 = Slider(3.131, range=0..6.283)
unit_x_2 = UnitX(Factor=1)
unit_y_2 = UnitY(Factor=1)
construct_point_3 = ConstructPoint(XCoordinate=base_x_2, YCoordinate=base_y_2, ZCoordinate=0)
gene_pool_3 = GenePool(Decimals=2, Maximum=3.14, Minimum=-3.14, Value=[-0.02, -0.59, 0.4, -1.75, 2.19, -0.1])
rotate_2 = Rotate(Geometry=[unit_x_2, unit_y_2], Angle=yaw_2, Plane=PlaneXY(0, 0, 0))  # -> Geometry, Transform
list_item_2 = ListItem(List=rotate_2.Geometry, Index=0, Wrap=True)  # -> Item, Item1
merge_2 = Merge(Data1=gene_pool_3)
construct_plane_3 = ConstructPlane(Origin=construct_point_3, XAxis=list_item_2.Item, YAxis=list_item_2.Item1)
python_3_script_8 = Python3Script(
    robot_cell=python_3_script_5.robot_cell,
    robot_cell_state=python_3_script_7.new_robot_cell_state,
    tool_name="Alice",
    joint_values=merge_2,
    base_frame=construct_plane_3)  # -> out, new_robot_cell_state; inputs joint_values: list of Double, base_frame: Plane
# ---------- python_3_script_8: Python ----------
# BUG: this will lose all object data
# new_robot_cell_state = robot_cell_state.copy()
from compas.geometry import Transformation, Frame

new_robot_cell_state = robot_cell_state.copy()
for i, joint_value in enumerate(joint_values):
    new_robot_cell_state.tool_states[tool_name].configuration.joint_values[i] = joint_value

from compas_rhino.conversions import plane_to_compas_frame

new_robot_cell_state.tool_states[tool_name].frame = world_from_base_frame = plane_to_compas_frame(base_frame)
world_from_base = Transformation.from_frame(world_from_base_frame)

tool_robot_model = robot_cell.tool_models[tool_name]

base_from_tool0_frame = Transformation.from_frame(
    tool_robot_model.forward_kinematics(new_robot_cell_state.tool_states[tool_name].configuration, link_name='ur_arm_tool0')
    )
world_from_tool0_frame = Frame.from_transformation(world_from_base * base_from_tool0_frame)
new_robot_cell_state.tool_states[f'SG{tool_name}'].frame = world_from_tool0_frame
# ---------- end python_3_script_8 ----------

base_x_3 = Slider(-0.36, range=-2..2)
base_y_3 = Slider(2, range=-2..2)
yaw_3 = Slider(2.65, range=0..6.283)
unit_x_3 = UnitX(Factor=1)
unit_y_3 = UnitY(Factor=1)
construct_point_4 = ConstructPoint(XCoordinate=base_x_3, YCoordinate=base_y_3, ZCoordinate=0)
gene_pool_4 = GenePool(Decimals=2, Maximum=3.14, Minimum=-3.14, Value=[-1.42, -0.59, -1.95, -1.75, 2.19, -0.1])
rotate_3 = Rotate(Geometry=[unit_x_3, unit_y_3], Angle=yaw_3, Plane=PlaneXY(0, 0, 0))  # -> Geometry, Transform
list_item_3 = ListItem(List=rotate_3.Geometry, Index=0, Wrap=True)  # -> Item, Item1
merge_3 = Merge(Data1=gene_pool_4)
construct_plane_4 = ConstructPlane(Origin=construct_point_4, XAxis=list_item_3.Item, YAxis=list_item_3.Item1)
python_3_script_9 = Python3Script(
    robot_cell=python_3_script_5.robot_cell,
    robot_cell_state=python_3_script_8.new_robot_cell_state,
    tool_name="Belle",
    joint_values=merge_3,
    base_frame=construct_plane_4)  # -> out, new_robot_cell_state; inputs joint_values: list of Double, base_frame: Plane; same code as python_3_script_8

remove_debug = Button()
disconnect = Button()
python_3_script_10 = Python3Script(x=remove_debug)  # -> remove_all_debug
# ---------- python_3_script_10: Python ----------
import pybullet_planning as pp
pp.remove_all_debug()
# ---------- end python_3_script_10 ----------
python_3_script_11 = Python3Script(trigger=disconnect)  # -> out
# ---------- python_3_script_11: Python ----------
import pybullet_planning as pp
if trigger:
    # client.__exit__()
    pp.disconnect()
# ---------- end python_3_script_11 ----------

# ---- group: loading the client for Cindy
connect_dual_arm = Button()
use_gui = BooleanToggle(True)
python_3_script_12 = Python3Script(trigger=connect_dual_arm, robot_cell=python_3_script_5.robot_cell, use_gui=use_gui)  # -> out, client, planner
# ---------- python_3_script_12: Python ----------
from compas_fab.backends import PyBulletClient
from compas_fab.backends import PyBulletPlanner
import pybullet as p
from scriptcontext import sticky as st
from compas_ghpython import create_id

gh_component = ghenv.Component
sticky_id = create_id(gh_component, '__')
if sticky_id not in st:
    st[sticky_id] = None, None

if trigger:
    client = PyBulletClient(connection_type="gui" if use_gui else "direct", verbose=True)
    client.__enter__()

    # Use PyBullet debug mode by enabling the debug visualizer and optionally adding debug lines/info
    # This will show joint axes, link frames, and other debug info in the GUI
    if use_gui:
        pass
        # p.configureDebugVisualizer(p.COV_ENABLE_GUI, 1, physicsClientId=client.client_id)
        # p.configureDebugVisualizer(p.COV_ENABLE_SHADOWS, 1, physicsClientId=client.client_id)
        # p.configureDebugVisualizer(p.COV_ENABLE_WIREFRAME, 1, physicsClientId=client.client_id)

    planner = PyBulletPlanner(client)
    planner.set_robot_cell(robot_cell)
    st[sticky_id] = client, planner

client, planner = st[sticky_id]
# ---------- end python_3_script_12 ----------

# ----
python_3_script_13 = Python3Script(planner=python_3_script_12.planner, robot_cell_state=python_3_script_9.new_robot_cell_state)  # -> out, planner
# ---------- python_3_script_13: Python ----------
import pybullet_planning as pp
from compas.geometry import Frame, Transformation

def pose_from_frame(frame, scale=1.0):
    return ([v*scale for v in frame.point], frame.quaternion.xyzw)

def frame_from_pose(pose, scale=1.0):
    point, (x, y, z, w) = pose
    return Frame.from_quaternion([w, x, y, z], point=[v*scale for v in point])

planner.set_robot_cell_state(robot_cell_state)

# robot_base_frame = robot_cell_state.robot_base_frame
# robot_base_pose = pose_from_frame(robot_base_frame)
# pp.set_pose(planner.client.robot_puid, robot_base_pose)
# ---------- end python_3_script_13 ----------
python_3_script_14 = Python3Script()  # -> out, a
# ---------- python_3_script_14: Python ----------
"""Grasshopper Script"""
a = "Hello Python 3 in Grasshopper!"
a.decode('UTF-8')
# ---------- end python_3_script_14 ----------

# ---- group: viz
python_3_script_15 = Python3Script(
    trigger=python_3_script_5.out,
    single_arm=Toggle(False),
    robot_cell=python_3_script_5.robot_cell,
    robot_cell_state=python_3_script_9.new_robot_cell_state,
    vis_options=python_3_script_6.options)  # -> out, draw, left_tool0_frame, right_tool0_frame
# ---------- python_3_script_15: Python ----------
#sss vsenv: compas_fab_dev

import scriptcontext as sc
from compas.scene import SceneObject
from compas.scene import Scene
from compas_rhino.conversions import frame_to_rhino_plane
from compas.geometry import Frame, Transformation

from compas_ghpython import create_id

# This script will leak memory due to unused and untracked sceneobject in sticky

debug = True
def debug_print(s):
    if debug:
        print(s)

# Create hash (scope limited to this component) for cacheing SceneObject
# The Data.sha256 function includes the guid of the compas object
#object_hash = object.sha256(as_string=True)
# The ID function is much faster than the sha256()
object_hash = str(id(robot_cell))
options_hash = vis_options.sha256(True)
# The ghenv.Component has a guid assigned by GH to each component instance
gh_component = ghenv.Component
sticky_id = create_id(gh_component, object_hash +"_"+ options_hash+str(single_arm))
debug_print("Cacheing ID: '{}'".format(sticky_id))

# If scene object exist in sticky
scene_object = None
if sc.sticky.has_key(sticky_id):
    scene_object = sc.sticky[sticky_id]
    # Double check if the item is the same
    if scene_object.item is robot_cell:
        debug_print("SceneObject '{}' reused for '{}'".format(type(scene_object).__name__, type(object).__name__))

# Create Scene Object
if scene_object is None:
    scene = Scene()
    kwargs = vis_options.__data__
    scene_object = scene.add(robot_cell, **kwargs)
    debug_print("SceneObject {} newly created for {}".format(type(scene_object).__name__, type(object).__name__))
    sc.sticky[sticky_id] = scene_object

# print(scene_object._scale)
draw = scene_object.draw(robot_cell_state)
world_from_base = Transformation.from_frame(robot_cell_state.robot_base_frame)
if not single_arm:
    base_from_left_tool0_frame = Transformation.from_frame(
        robot_cell.robot_model.forward_kinematics(robot_cell_state.robot_configuration, link_name='left_ur_arm_tool0'))
    left_tool0_frame = frame_to_rhino_plane(Frame.from_transformation(world_from_base * base_from_left_tool0_frame))

    base_from_right_tool0_frame = Transformation.from_frame(
        robot_cell.robot_model.forward_kinematics(robot_cell_state.robot_configuration, link_name='right_ur_arm_tool0'))
    right_tool0_frame = frame_to_rhino_plane(Frame.from_transformation(world_from_base * base_from_right_tool0_frame))
else:
    base_from_tool0_frame = Transformation.from_frame(
        robot_cell.robot_model.forward_kinematics(robot_cell_state.robot_configuration, link_name='ur_arm_tool0'))
    tool0_frame = frame_to_rhino_plane(Frame.from_transformation(world_from_base * base_from_tool0_frame))
# ---------- end python_3_script_15 ----------
draw = GhPythonScript(planes=[python_3_script_15.left_tool0_frame, python_3_script_15.right_tool0_frame], scale=Slider(0.1, range=0..1))  # -> P, V, C, W; inputs planes: list
# ---------- draw: Python ----------
from System.Drawing import Color

red = Color.FromArgb(255, 0, 0)
green = Color.FromArgb(0, 255, 0)
blue = Color.FromArgb(0, 0, 255)

P = []
V = []
C = []

scale = float(scale)

for plane in planes:
    if not plane:
        continue
    P += [plane.Origin] * 3
    V.append(plane.XAxis * scale)
    V.append(plane.YAxis * scale)
    V.append(plane.ZAxis * scale)
    C += [red, green, blue]

W = 3
# ---------- end draw ----------
vdisex = VectorDisplayEx(Point=draw.P, Vector=draw.V, Colour=draw.C, Width=draw.W)

# ----
rhino_doc_dir = RhinoDocDir()  # -> rhino_doc_dir
# ---------- rhino_doc_dir: Python ----------
import scriptcontext as sc
from os import path

rhino_doc_dir = path.abspath(path.dirname(sc.doc.Path))
# ---------- end rhino_doc_dir ----------
panel_3 = Panel(rhino_doc_dir)
button = Button()
python_3_script_16 = Python3Script(
    save_robot_cell=Button(),
    save_state=Toggle(True),
    robot_cell=python_3_script_5.robot_cell,
    robot_cell_state=python_3_script_9.new_robot_cell_state,
    file_path=rhino_doc_dir,
    state_name="test_tool")  # -> out, a; inputs file_path: String, state_name: String
# ---------- python_3_script_16: Python ----------
# export_robotcell_to_json.py

import json, os
from compas import json_dump, json_load
from compas_fab.robots import RobotCell, RobotCellState

def export_robotcell_and_state(content, filepath):
    content_class = type(content).__name__
    # print(content_class)
    with open(os.path.join(filepath , '{}.json'.format(content_class)), "w") as f:
        json_dump(content, f, pretty=True)
        
    print(f"Exported {content_class} to {filepath}\{content_class}.json'")

# Example usage:
# robot_cell, robot_cell_state = ... (your objects)
if save_robot_cell and robot_cell is not None:
    export_robotcell_and_state(robot_cell, os.path.join(file_path))
if save_state and robot_cell_state is not None:
    export_robotcell_and_state(robot_cell_state, os.path.join(file_path, 'RobotCellStates'))
# ---------- end python_3_script_16 ----------
panel_4 = Panel(python_3_script_16.out)
