# Grasshopper definition robot_cell_with_validation_tool.gh (Grasshopper 1.0.8)

panel = Panel("D:\0_Project\03-2025_husky_assembly\Code\husky-assembly-teleop\data\husky_urdf")

point = Point(Point(-100, 0, 0))
point_2 = Point(Point(0, 0, 0))
point_3 = Point(Point(0, 100, 0))
mesh = Mesh(<mesh referenced from the Rhino model>)
plane_3pt = Plane3Pt(PointA=point_2, PointB=point_3, PointC=point)
orient = Orient(Geometry=mesh, Source=plane_3pt, Target=PlaneXY(0, 0, 0))  # -> Geometry, Transform
point_4 = Point(Point(-100, 0, 25))
point_5 = Point(Point(0, 0, 25))
point_6 = Point(Point(0, 100, 25))
scale = Scale(Geometry=orient.Geometry, Center=Point(0, 0, 0), Factor="0.001")  # -> Geometry, Transform
plane_3pt_2 = Plane3Pt(PointA=point_5, PointB=point_6, PointC=point_4)
orient_2 = Orient(Geometry=plane_3pt_2, Source=plane_3pt, Target=PlaneXY(0, 0, 0))  # -> Geometry, Transform
scale_2 = Scale(Geometry=orient_2.Geometry, Center=Point(0, 0, 0), Factor="0.001")  # -> Geometry, Transform
python_3_script = Python3Script(name="BoardTool", tool_visual_meshes=scale.Geometry, tool_collision_meshes=scale.Geometry, tool_frame=scale_2.Geometry)  # -> out, tool_model; inputs tool_visual_meshes: list of Mesh, tool_collision_meshes: list of Mesh, tool_frame: Plane
# ---------- python_3_script: Python ----------
from compas_robots import ToolModel
from compas.geometry import Transformation
from compas_rhino.conversions import plane_to_compas_frame, mesh_to_compas

cp_visual_meshes = [mesh_to_compas(vm) for vm in tool_visual_meshes]
cp_collision_meshes = [mesh_to_compas(vm) for vm in tool_collision_meshes]
cp_tool_frame = plane_to_compas_frame(tool_frame)

tool_model = ToolModel(None, cp_tool_frame, None, name)

tool_model.add_link("attached_tool_link", visual_meshes=cp_visual_meshes, collision_meshes=cp_collision_meshes)
tool_model._rebuild_tree()
tool_model._create(tool_model.root, Transformation())
# ---------- end python_3_script ----------

point_7 = Point(Point(-100, 0, 50))
point_8 = Point(Point(0, 0, 50))
point_9 = Point(Point(0, -100, 50))
number_slider = Slider(0.9, range=0..2)
plane_3pt_3 = Plane3Pt(PointA=point_8, PointB=point_9, PointC=point_7)
xy_plane = XYPlane(Origin=Point(0, 0, 0))
boolean_toggle = BooleanToggle(True)

# ----
# Dual-arm Husky
load_robot = Button()
python_3_script_2 = Python3Script(
    load=load_robot,
    pkg_path=panel,
    pkg_name="mt_husky_dual_ur5_e_moveit_config",
    urdf_file="husky_dual_ur5_e_no_base_joint.urdf",
    srdf_file="dual_arm_husky.srdf")  # -> out, robot_model, robot_semantics
# ---------- python_3_script_2: Python ----------
from scriptcontext import sticky as st
import os
import compas

from compas_robots import RobotModel
from compas_robots.resources import GithubPackageMeshLoader
from compas_robots.resources import LocalPackageMeshLoader
from compas_robots.ghpython.scene import RobotModelObject
# from compas_fab.robots import Robot
from compas_fab.robots import RobotSemantics
# from compas_ghpython.artists import RobotModelArtist

# Robot meshes are usually in meters
# Set a high percision to prevent parsing errors
# and configure Rhino itself in meters
compas.PRECISION = '12f'

# Store robot in component-based key
# ghenv.Component.InstanceGuid
robot_key = 'robot_{}'.format(str('dual-arm_husky_Cindy'))

if robot_key not in st:
    st[robot_key] = None

loader = LocalPackageMeshLoader(os.path.join(pkg_path), pkg_name)

if load:
# if True:
    # Also load geometry
    husky_loader = LocalPackageMeshLoader(os.path.join(pkg_path), "husky_description")
    dualarm_husky_loader = LocalPackageMeshLoader(os.path.join(pkg_path), "husky_ur_description")
    ur_loader = LocalPackageMeshLoader(os.path.join(pkg_path), "ur_description")
    
    # Create robot model from URDF
    model = RobotModel.from_urdf_string(loader.load_urdf(urdf_file).read())
    model.load_geometry(loader, husky_loader, dualarm_husky_loader, ur_loader)
    print(model)

    # # artist = RobotModelArtist(model)
    # scene_object = RobotModelObject(item=model)

    # # robot = Robot(model)
    # robot = Robot(model, scene_object, semantics=robot_semantics)
##    robot.scale(1000)
    st[robot_key] = model

robot_model = st[robot_key]
robot_semantics = None
if srdf_file:
    robot_semantics = RobotSemantics.from_srdf_file(loader.build_path('config', srdf_file), robot_model)


#repo    = 'ros-industrial/abb'
#package = 'abb_irb6600_support'
#branch  = 'kinetic-devel'
#
#github = GithubPackageMeshLoader(repo, package, branch)
#
#model = RobotModel.from_urdf_file(github.load_urdf('irb6640.urdf'))
#model.load_geometry(github)
#artist = RobotModelArtist(model)
#robot = Robot(model, artist)
# ---------- end python_3_script_2 ----------

construct_point = ConstructPoint(XCoordinate=number_slider, YCoordinate=0, ZCoordinate=number_slider)
construct_plane = ConstructPlane(Origin=construct_point, XAxis=Vector(1, 0, 0), YAxis=Vector(0, 1, 0))
merge = Merge(Data1=plane_3pt_3, Data2=plane_3pt_2)

# ---- group: mobile base position
base_x = Slider(0, range=-2..2)
base_y = Slider(0, range=-2..2)
yaw = Slider(0, range=0..6.283)
unit_x = UnitX(Factor=1)
unit_y = UnitY(Factor=1)
construct_point_2 = ConstructPoint(XCoordinate=base_x, YCoordinate=base_y, ZCoordinate=0)
rotate = Rotate(Geometry=[unit_x, unit_y], Angle=yaw, Plane=PlaneXY(0, 0, 0))  # -> Geometry, Transform
list_item = ListItem(List=rotate.Geometry, Index=0, Wrap=True)  # -> Item, Item1
construct_plane_2 = ConstructPlane(Origin=construct_point_2, XAxis=list_item.Item, YAxis=list_item.Item1)

# ----
scale_3 = Scale(Geometry=merge, Center=Point(0, 0, 0), Factor="0.001")  # -> Geometry, Transform

visualization_scale = Slider(1, range=0..2)
python_3_script_3 = Python3Script(draw_collision=Toggle(False), draw_visual=Toggle(True), scale=visualization_scale)  # -> out, options; inputs scale: Double
# ---------- python_3_script_3: Python ----------
from compas.data import Data
class RobotCellVisualizationOptions(Data):
    def __init__(self, draw_collision, draw_visual, scale):
        super(RobotCellVisualizationOptions, self).__init__()
        self.draw_collision = draw_collision
        self.draw_visual = draw_visual
        self.native_scale = scale

    @property
    def __data__(self):
        data = {
            'draw_collision': self.draw_collision,
            'draw_visual': self.draw_visual,
            'native_scale': self.native_scale,
            }
        return data

options = RobotCellVisualizationOptions(draw_collision, draw_visual, scale)

print(options.sha256(True))
# ---------- end python_3_script_3 ----------

draw = GhPythonScript(planes=scale_3.Geometry, scale=Slider(0.009, range=0..1))  # -> P, V, C, W; inputs planes: list
# ---------- draw: Python ----------
from System.Drawing import Color

red = Color.FromArgb(255, 0, 0)
green = Color.FromArgb(0, 255, 0)
blue = Color.FromArgb(0, 0, 255)

P = []
V = []
C = []

scale = float(scale)

for plane in planes:
    if not plane:
        continue
    P += [plane.Origin] * 3
    V.append(plane.XAxis * scale)
    V.append(plane.YAxis * scale)
    V.append(plane.ZAxis * scale)
    C += [red, green, blue]

W = 3
# ---------- end draw ----------
panel_2 = Panel("0.001")

# ---- group: joint conf initial guess
gene_pool = GenePool(Decimals=2, Maximum=3.14, Minimum=-3.14, Value=[-0.38, -0.66, -1.88, -2.5, -2.31, -0.53])
gene_pool_2 = GenePool(Decimals=2, Maximum=3.14, Minimum=-3.14, Value=[-1.52, -0.77, 0.4, -1.71, 2.19, -0.1])
merge_2 = Merge(Data1=gene_pool_2, Data2=gene_pool)

# ----
vdisex = VectorDisplayEx(Point=draw.P, Vector=draw.V, Colour=draw.C, Width=draw.W)

remove_debug = Button()
disconnect = Button()
python_3_script_4 = Python3Script(x=remove_debug)  # -> remove_all_debug
# ---------- python_3_script_4: Python ----------
import pybullet_planning as pp
pp.remove_all_debug()
# ---------- end python_3_script_4 ----------
python_3_script_5 = Python3Script(trigger=disconnect)  # -> out
# ---------- python_3_script_5: Python ----------
import pybullet_planning as pp
if trigger:
    # client.__exit__()
    pp.disconnect()
# ---------- end python_3_script_5 ----------

panel_3 = Panel("D:\0_Project\03-2025_husky_assembly\Code\husky-assembly-teleop\data\husky_assembly_design_study\250808_cindy_calibration_validation")
plane = Plane(scale_3.Geometry)
rhino_doc_dir = RhinoDocDir()  # -> rhino_doc_dir
# ---------- rhino_doc_dir: Python ----------
import scriptcontext as sc
from os import path

rhino_doc_dir = path.abspath(path.dirname(sc.doc.Path))
# ---------- end rhino_doc_dir ----------
list_item_2 = ListItem(List=plane, Index=0, Wrap=True)  # -> Item, Item1
panel_4 = Panel("base_right_arm_manipulator")
panel_5 = Panel("base_left_arm_manipulator")
panel_6 = Panel(panel_3)
save_cell = Button()
save_state = Button()

point_10 = Point(Point(-100, 0, 85))
point_11 = Point(Point(0, 0, 85))
point_12 = Point(Point(0, -100, 85))
mesh_2 = Mesh(<mesh referenced from the Rhino model>)
plane_3pt_4 = Plane3Pt(PointA=point_11, PointB=point_12, PointC=point_10)
orient_3 = Orient(Geometry=mesh_2, Source=plane_3pt_4, Target=PlaneXY(0, 0, 0))  # -> Geometry, Transform
scale_4 = Scale(Geometry=orient_3.Geometry, Center=Point(0, 0, 0), Factor="0.001")  # -> Geometry, Transform
orient_4 = Orient(Geometry=plane_3pt_3, Source=plane_3pt_4, Target=PlaneXY(0, 0, 0))  # -> Geometry, Transform

scale_5 = Scale(Geometry=orient_4.Geometry, Center=Point(0, 0, 0), Factor="0.001")  # -> Geometry, Transform

python_3_script_6 = Python3Script(
    name="PointTool",
    tool_visual_meshes=scale_4.Geometry,
    tool_collision_meshes=scale_4.Geometry,
    tool_frame=scale_5.Geometry)  # -> out, tool_model; inputs tool_visual_meshes: list of Mesh, tool_collision_meshes: list of Mesh, tool_frame: Plane; same code as python_3_script

python_3_script_7 = Python3Script(
    robot_model=python_3_script_2.robot_model,
    robot_semantics=python_3_script_2.robot_semantics,
    point_tool=python_3_script_6.tool_model,
    board_tool=python_3_script.tool_model,
    object_frame=construct_plane,
    is_hidden=Toggle(False))  # -> out, robot_cell, robot_cell_state; inputs rigid_bodies: list, object_frame: Plane
# ---------- python_3_script_7: Python ----------
#aasss venv: compas_fab_dev

from compas_fab.robots import RobotCell
from compas_fab.robots import RobotCellState
from compas_fab.robots import RigidBodyState
from compas.geometry import Box
from compas.geometry import Frame
from compas_rhino.conversions import plane_to_compas_frame

from compas_fab.robots import RobotCellLibrary
from compas_robots import ToolModel

robot_cell = RobotCell(robot_model, robot_semantics)

# robot_cell.tool_models['Alice'] = ToolModel.from_robot_model(support_robot_model.copy(), Frame.worldXY())
# robot_cell.tool_models['Belle'] = ToolModel.from_robot_model(support_robot_model.copy(), Frame.worldXY())

# robot_cell.tool_models['AL'] = assembly_tool.copy()
# robot_cell.tool_models['AR'] = assembly_tool.copy()

#################
robot_cell.tool_models['PointTool'] = point_tool.copy()
robot_cell.tool_models['BoardTool'] = board_tool.copy()

#################
robot_cell_state = robot_cell.default_cell_state()

robot_cell_state.tool_states['PointTool'].attached_to_group = 'base_left_arm_manipulator'
robot_cell_state.tool_states['PointTool'].touch_links = ['left_ur_arm_wrist_3_link']

robot_cell_state.tool_states['BoardTool'].attached_to_group = 'base_right_arm_manipulator'
robot_cell_state.tool_states['BoardTool'].touch_links = ['right_ur_arm_wrist_3_link']

# if (rigid_bodies):
#     # Make sure RBs have unique names
#     assert len(set([rb.name for rb in rigid_bodies])) == len(rigid_bodies)
#     for rb in rigid_bodies:
#         assert rb.name
#         robot_cell.rigid_body_models[rb.name] = rb
#         robot_cell_state.rigid_body_states[rb.name] = RigidBodyState(
#             plane_to_compas_frame(object_frame),
#             is_hidden=is_hidden,
#         )

from compas.scene import Scene
scene = Scene()
scene.add(robot_cell)
# ---------- end python_3_script_7 ----------
python_3_script_8 = Python3Script(robot_cell_state=python_3_script_7.robot_cell_state, joint_values=merge_2, base_frame=construct_plane_2)  # -> out, new_robot_cell_state; inputs joint_values: list of Double, base_frame: Plane
# ---------- python_3_script_8: Python ----------
# BUG: this will lose all object data
# new_robot_cell_state = robot_cell_state.copy()

new_robot_cell_state = robot_cell_state.copy()
for i, joint_value in enumerate(joint_values):
    new_robot_cell_state.robot_configuration.joint_values[i] = joint_value

from compas_rhino.conversions import plane_to_compas_frame

new_robot_cell_state.robot_base_frame = plane_to_compas_frame(base_frame)

print(new_robot_cell_state.rigid_body_ids) #states['b0'].frame)
# ---------- end python_3_script_8 ----------

# ---- group: loading the client for Cindy
connect_dual_arm = Button()
use_gui = BooleanToggle(False)
python_3_script_9 = Python3Script(trigger=connect_dual_arm, robot_cell=python_3_script_7.robot_cell, use_gui=use_gui)  # -> out, client, planner
# ---------- python_3_script_9: Python ----------
from compas_fab.backends import PyBulletClient
from compas_fab.backends import PyBulletPlanner
import pybullet as p
from scriptcontext import sticky as st
from compas_ghpython import create_id

gh_component = ghenv.Component
sticky_id = create_id(gh_component, '__')
if sticky_id not in st:
    st[sticky_id] = None, None

if trigger:
    client = PyBulletClient(connection_type="gui" if use_gui else "direct", verbose=True)
    client.__enter__()

    # Use PyBullet debug mode by enabling the debug visualizer and optionally adding debug lines/info
    # This will show joint axes, link frames, and other debug info in the GUI
    if use_gui:
        pass
        # p.configureDebugVisualizer(p.COV_ENABLE_GUI, 1, physicsClientId=client.client_id)
        # p.configureDebugVisualizer(p.COV_ENABLE_SHADOWS, 1, physicsClientId=client.client_id)
        # p.configureDebugVisualizer(p.COV_ENABLE_WIREFRAME, 1, physicsClientId=client.client_id)

    planner = PyBulletPlanner(client)
    st[sticky_id] = client, planner

client, planner = st[sticky_id]
if planner is not None:
    planner.set_robot_cell(robot_cell)
# ---------- end python_3_script_9 ----------

# ----
python_3_script_10 = Python3Script(planner=python_3_script_9.planner, robot_cell_state=python_3_script_8.new_robot_cell_state)  # -> out, planner
# ---------- python_3_script_10: Python ----------
import pybullet_planning as pp
from compas.geometry import Frame, Transformation

def pose_from_frame(frame, scale=1.0):
    return ([v*scale for v in frame.point], frame.quaternion.xyzw)

def frame_from_pose(pose, scale=1.0):
    point, (x, y, z, w) = pose
    return Frame.from_quaternion([w, x, y, z], point=[v*scale for v in point])

planner.set_robot_cell_state(robot_cell_state)

# robot_base_frame = robot_cell_state.robot_base_frame
# robot_base_pose = pose_from_frame(robot_base_frame)
# pp.set_pose(planner.client.robot_puid, robot_base_pose)
# ---------- end python_3_script_10 ----------

# ---- group: pb backend ik test
python_3_script_11 = Python3Script(
    trigger=Toggle(True),
    planner=python_3_script_10.planner,
    robot_cell_state=python_3_script_8.new_robot_cell_state,
    LEFT_ARM_GROUP=panel_5,
    RIGHT_ARM_GROUP=panel_4,
    A_from_point_tool=list_item_2.Item,
    A_from_board_tool=list_item_2.Item1,
    check_collision=Toggle(True))  # -> out, new_robot_cell_state; inputs A_from_point_tool: Plane, A_from_board_tool: Plane
# ---------- python_3_script_11: Python ----------
from compas.geometry import Frame
import random
import time

from compas_fab.backends import PyBulletClient
from compas_fab.backends import PyBulletPlanner
from compas_fab.robots import FrameTarget
from compas_fab.robots import RobotCellLibrary
from compas_fab.robots import TargetMode
from compas_fab.backends import CollisionCheckError
from compas_fab.backends.exceptions import InverseKinematicsError
from compas_rhino.conversions import plane_to_compas_frame
import pybullet_planning as pp
import pybullet as p

from compas.geometry import Frame, Transformation

def pose_from_frame(frame, scale=1.0):
    return ([v*scale for v in frame.point], frame.quaternion.xyzw)

def frame_from_pose(pose, scale=1.0):
    point, (x, y, z, w) = pose
    return Frame.from_quaternion([w, x, y, z], point=[v*scale for v in point])

# Maximum number of sampling attempts
MAX_SAMPLING_ATTEMPTS = 100

new_robot_cell_state = None

if trigger:
    print(planner.client._get_pose_joint_names_and_puids())

    new_robot_cell_state = robot_cell_state.copy()
    
    # Step 0: Compute transformation between the two tool frames
    # Convert Grasshopper planes to COMPAS frames
    A_from_point_tool_tf = Transformation.from_frame(plane_to_compas_frame(A_from_point_tool))
    A_from_board_tool_tf = Transformation.from_frame(plane_to_compas_frame(A_from_board_tool))
    
    # Compute the transformation from point_tool to board_tool
    # point_tool_from_board_tool = A_from_point_tool.inverse() * A_from_board_tool
    point_tool_from_board_tool = A_from_point_tool_tf.inverse() * A_from_board_tool_tf
    
    print("Transformation from point_tool to board_tool:")
    print(point_tool_from_board_tool)
    
    # Main sampling loop - combines left arm sampling and right arm IK
    sampling_attempts = 0
    success = False
    
    while sampling_attempts < MAX_SAMPLING_ATTEMPTS and not success:
        sampling_attempts += 1
        print(f"Sampling attempt {sampling_attempts}")
        
        # Step 1: Sample left arm configuration randomly
        left_arm_config = planner.client.robot_cell.random_configuration(LEFT_ARM_GROUP)
        
        # Update the robot cell state with the random left arm configuration
        left_arm_joint_names = planner.client.robot_cell.get_configurable_joint_names(LEFT_ARM_GROUP)
        for joint_name, joint_value in zip(left_arm_config.joint_names, left_arm_config.joint_values):
            new_robot_cell_state.robot_configuration[joint_name] = joint_value
        
        # Check if the left arm configuration is in collision
        try:
            planner.check_collision(new_robot_cell_state)
        except CollisionCheckError as e:
            print(f"Left arm configuration {sampling_attempts} in collision: {e}")
            continue
        
        print(f"Found collision-free left arm configuration after {sampling_attempts} attempts")
        
        # Step 2: Get the attached tool TCF in World coordinate frame using TargetMode.TOOL
        world_from_point_tool = planner.forward_kinematics(new_robot_cell_state, TargetMode.TOOL, group=LEFT_ARM_GROUP)
        print("Point tool TCF frame in World coordinate frame:")
        print(world_from_point_tool)
        pp.draw_pose(pose_from_frame(world_from_point_tool))

        # Transform to get the board tool frame in world coordinates
        # world_from_board_tool = world_from_point_tool * point_tool_from_board_tool
        world_from_board_tool = Transformation.from_frame(world_from_point_tool) * point_tool_from_board_tool
        
        print("Board tool TCF frame in World coordinate frame:")
        print(world_from_board_tool)
        pp.draw_pose(pose_from_frame(Frame.from_transformation(world_from_board_tool)))

        # Step 3: Solve IK for the right arm using the transformed TCF frame as target
        target = FrameTarget(Frame.from_transformation(world_from_board_tool), TargetMode.TOOL)
        
        options = {"max_results": 20, "check_collision": check_collision}
        
        try:
            right_arm_config = planner.inverse_kinematics(
                target, 
                new_robot_cell_state, 
                group=RIGHT_ARM_GROUP, 
                options=options
            )
        
            if right_arm_config is not None:
                # Update the right arm joints in the robot cell state
                right_arm_joint_names = planner.client.robot_cell.get_configurable_joint_names(RIGHT_ARM_GROUP)
                for joint_name, joint_value in zip(right_arm_config.joint_names, right_arm_config.joint_values):
                    if joint_name in right_arm_joint_names:
                        new_robot_cell_state.robot_configuration[joint_name] = joint_value
                
                # Set the final configuration to the planner
                planner.client._set_robot_configuration(new_robot_cell_state.robot_configuration)
                print("Successfully found IK solution for both arms")
                print("Final configuration:", new_robot_cell_state.robot_configuration)
                success = True
        except InverseKinematicsError as e:
            print(f"No IK solution found for right arm in attempt {sampling_attempts}, {e} \nresampling left arm...")
            continue
    
    if not success:
        print(f"Failed to find valid configuration pair after {MAX_SAMPLING_ATTEMPTS} attempts")
# ---------- end python_3_script_11 ----------

# ---- group: viz
python_3_script_12 = Python3Script(
    trigger=python_3_script_7.out,
    planner=python_3_script_10.planner,
    robot_cell=python_3_script_7.robot_cell,
    robot_cell_state=python_3_script_11.new_robot_cell_state,
    LEFT_ARM_GROUP=panel_5,
    RIGHT_ARM_GROUP=panel_4,
    vis_options=python_3_script_3.options)  # -> out, draw, left_tcp_frame, right_tcp_frame
# ---------- python_3_script_12: Python ----------
#sss vsenv: compas_fab_dev

import scriptcontext as sc
from compas.scene import SceneObject
from compas.scene import Scene
from compas_rhino.conversions import frame_to_rhino_plane
from compas.geometry import Frame, Transformation

from compas_ghpython import create_id

# This script will leak memory due to unused and untracked sceneobject in sticky

debug = True
def debug_print(s):
    if debug:
        print(s)

# Create hash (scope limited to this component) for cacheing SceneObject
# The Data.sha256 function includes the guid of the compas object
#object_hash = object.sha256(as_string=True)
# The ID function is much faster than the sha256()
object_hash = str(id(robot_cell))
options_hash = vis_options.sha256(True)
# The ghenv.Component has a guid assigned by GH to each component instance
gh_component = ghenv.Component
sticky_id = create_id(gh_component, object_hash +"_"+ options_hash)
debug_print("Cacheing ID: '{}'".format(sticky_id))

# If scene object exist in sticky
scene_object = None
if sc.sticky.has_key(sticky_id):
    scene_object = sc.sticky[sticky_id]
    # Double check if the item is the same
    if scene_object.item is robot_cell:
        debug_print("SceneObject '{}' reused for '{}'".format(type(scene_object).__name__, type(object).__name__))

# Create Scene Object
if scene_object is None:
    scene = Scene()
    kwargs = vis_options.__data__
    scene_object = scene.add(robot_cell, **kwargs)
    debug_print("SceneObject {} newly created for {}".format(type(scene_object).__name__, type(object).__name__))
    sc.sticky[sticky_id] = scene_object

# print(scene_object._scale)
draw = scene_object.draw(robot_cell_state)
world_from_base = Transformation.from_frame(robot_cell_state.robot_base_frame)
if True:
    base_from_left_tool0_frame = Transformation.from_frame(
        robot_cell.robot_model.forward_kinematics(robot_cell_state.robot_configuration, link_name='left_ur_arm_tool0'))
    left_tool0_frame = frame_to_rhino_plane(Frame.from_transformation(world_from_base * base_from_left_tool0_frame))

    base_from_right_tool0_frame = Transformation.from_frame(
        robot_cell.robot_model.forward_kinematics(robot_cell_state.robot_configuration, link_name='right_ur_arm_tool0'))
    right_tool0_frame = frame_to_rhino_plane(Frame.from_transformation(world_from_base * base_from_right_tool0_frame))
# else:
#     base_from_tool0_frame = Transformation.from_frame(
#         robot_cell.robot_model.forward_kinematics(robot_cell_state.robot_configuration, link_name='ur_arm_tool0'))
#     tool0_frame = frame_to_rhino_plane(Frame.from_transformation(world_from_base * base_from_tool0_frame))

from compas_fab.robots import FrameTarget
from compas_fab.robots import TargetMode

world_from_point_tool = planner.forward_kinematics(robot_cell_state, TargetMode.TOOL, group=LEFT_ARM_GROUP)
left_tcp_frame = frame_to_rhino_plane(world_from_point_tool)
world_from_board_tool = planner.forward_kinematics(robot_cell_state, TargetMode.TOOL, group=RIGHT_ARM_GROUP)
right_tcp_frame = frame_to_rhino_plane(world_from_board_tool)


ee_link_name = robot_cell.get_end_effector_link_name(group=LEFT_ARM_GROUP)
print("Frame of the T0CF (name='{}') in World Coordinate Frame:".format(ee_link_name))
# ---------- end python_3_script_12 ----------
draw_2 = GhPythonScript(planes=[python_3_script_12.left_tcp_frame, python_3_script_12.right_tcp_frame], scale=Slider(0.1, range=0..1))  # -> P, V, C, W; inputs planes: list; same code as draw
vdisex_2 = VectorDisplayEx(Point=draw_2.P, Vector=draw_2.V, Colour=draw_2.C, Width=draw_2.W)

# ----
python_3_script_13 = Python3Script(
    save_robot_cell=save_cell,
    save_state=save_state,
    robot_cell=python_3_script_7.robot_cell,
    robot_cell_state=python_3_script_8.new_robot_cell_state,
    file_path=panel_3,
    state_name="validation")  # -> out, a; inputs file_path: String, state_name: String
# ---------- python_3_script_13: Python ----------
# export_robotcell_to_json.py

import json
import os
from datetime import datetime
from compas import json_dump, json_load
from compas_fab.robots import RobotCell, RobotCellState


def export_robotcell_and_state(content, filepath, file_prefix=None):
    os.makedirs(filepath, exist_ok=True)  # Ensure directory exists

    content_class = type(content).__name__
    if file_prefix:
        # If this is a RobotCellState, append timestamp for uniqueness
        if isinstance(content, RobotCellState):
            timestamp = datetime.now().strftime("%Y%m%d_%H%M%S")
            file_prefix = f"{file_prefix}_{timestamp}"
        file_name = f"{file_prefix}_{content_class}.json"
    else:
        file_name = f"{content_class}.json"

    full_path = os.path.join(filepath, file_name)

    with open(full_path, "w") as f:
        json_dump(content, f, pretty=True)

    print(f"Exported {content_class} to {full_path}")


# Example usage:
# robot_cell, robot_cell_state = ... (your objects)
if save_robot_cell and robot_cell is not None:
    export_robotcell_and_state(robot_cell, file_path)
if save_state and robot_cell_state is not None:
    export_robotcell_and_state(
        robot_cell_state,
        os.path.join(file_path, 'RobotCellStates'),
        state_name
    )
# ---------- end python_3_script_13 ----------
panel_7 = Panel(python_3_script_13.out)
panel_8 = Panel(python_3_script_11.out)
